# Grasshopper definition PathCreation.gh (Grasshopper 1.0.7)
# plug-ins: Human, PathCreation, EleFront, UiPlus, ProvingGround.Conduit

crv = Curve(reparameterize(<curve referenced from the Rhino model>))
crv_2 = Curve(reparameterize(crv))
scalebox = ScaleBox(num=Slider(3, range=0..100), R=crv_2)
eval = EvaluateCurve(Curve=crv_2, Parameter=Slider(0.7, range=0..1))  # -> Point, Tangent, Angle
外侧道路宽度 = Slider(7, range=0..10)
主要道路宽度 = Slider(6, range=0..10)
连接道路宽度 = Slider(3, range=0..10)
button = UiButton(Label="清空连线起点终点数据")
get_values = UIValues(Element=button)
c_script = CSharpScript(x=get_values)  # -> out, A; inputs x: Boolean
# ---------- c_script: C# ----------
    if(x == false) A = "选择";
# ---------- end c_script ----------
rh_sel_btn = UIRhinoSelectButton(Label=c_script.A, Filter=1)
label = UiLabel(Label="提示：分组选择，请按照“起点->终点”的顺序选择，单击按钮可添加下一组")
merge = Merge(Data1=label, Data2=rh_sel_btn, Data3=button)  # -> flatten(Result)
get_values_2 = UIValues(Element=rh_sel_btn)
align = UiAlign(Element=merge, Alignment=1)
panel = Panel(get_values_2)
window = UIWindow(Elements=align, Title="选择起始点与终点", Owner=1, Launch=Button())
reflay = ReferenceByLayer(LayerName="楼栋平面", DisableAutoUpdate=False)
button_2 = Button()
data_rec = PythonScript(x=panel, enable=Toggle(True), reset=get_values)  # -> x; inputs x: tree, enable: Boolean, reset: Boolean, limit: Int32
# ---------- data_rec: Python ----------
from Grasshopper import DataTree
if reset or 'rec' not in globals(): rec = DataTree[object]()
if enable and not reset: rec.MergeTree(x)
if limit > 0:
  for branch in rec.Branches:
    if branch.Count > limit:
      branch.RemoveRange(0, branch.Count - limit)
x = rec
# ---------- end data_rec ----------
slider = UiSlider(Value=0.5, Bounds=Domain(0, 1), Increment=0.1)
reflay_2 = ReferenceByLayer(LayerName="场地外围线", DisableAutoUpdate=False)
reflay_3 = ReferenceByLayer(LayerName="连接道路线", DisableAutoUpdate=False)
panel_2 = Panel(reflay)
reflay_4 = ReferenceByLayer(LayerName="主要道路线", DisableAutoUpdate=False)
equals = Equality(FirstNumber=button_2, SecondNumber=Toggle(False))  # -> Equality, Inequality
crv_3 = Curve(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)
crv_4 = Curve([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])
pt = Point(data_rec)
flatten = FlattenTree(Tree=pt, Path="{0}")
reflay_5 = ReferenceByLayer(LayerName="连接道路线", DisableAutoUpdate=False)
楼栋平面_default = Curve([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])
panel_3 = Panel(reflay_2)
partition = PartitionList(List=flatten, Size=Slider(2, range=0..10))
lng = ListLength(List=flatten(partition))
selobj = ObjectsBySelection(Reset=equals.Equality, LiveMode=False)
panel_4 = Panel(reflay_4)
window_2 = UiWindow(Elements=slider, Title="道路宽度", Owner=1, Scroll=False, Launch=button_2)
panel_5 = Panel(reflay_3)
combine = CombineData(Input0=reflay_4, Input1=crv_4)  # -> Result, Index
panel_6 = Panel(pt)
combine_2 = CombineData(Input0=reflay_3, Input1=crv_3)  # -> Result, Index
panel_7 = Panel(reflay_5)
判断数据匹配是否有问题 = CSharpScript(x=lng)  # -> A; inputs x: Int32
# ---------- 判断数据匹配是否有问题: C# ----------
    if(x % 2 == 0)
      A = false;
    else
      A = true;
# ---------- end 判断数据匹配是否有问题 ----------

panel_8 = Panel("""起始点与终点数量无法匹配，
请重新选择""")
警告 = 警告(text=panel_8, height=Slider(20, range=0..100))  # -> drawobjs, G
hud = HeadsUpDisplayHUD(
    ShowHUD=判断数据匹配是否有问题,
    DrawingObjects=警告.drawobjs,
    DrawingBoundary=警告.G,
    ConduitStyleSheet="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")

连接道路宽度_2 = Number(连接道路宽度)
lng_2 = ListLength(List=reflay_3)
combine_3 = CombineData(Input0=reflay, Input1=楼栋平面_default)  # -> Result, Index
id = Guid(selobj)
gate = StreamGate(Stream=partition, Gate=判断数据匹配是否有问题)  # -> Target0, Target1
楼栋平面 = Curve(combine_3.Result)
crv_5 = Curve(combine.Result)
get_values_3 = UiValues(Element=slider)
场地外围线_default = Curve(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)
dup = DuplicateData(Data=连接道路宽度_2, Number=lng_2, Order=True)
item = ListItem(List=gate.Target0, Index=0, Wrap=True)  # -> Item, Item1
id_2 = Guid(reflay_3)
flatten_2 = FlattenTree(Tree=楼栋平面, Path="{0}")
c_script_2 = CSharpScript(all_GUID=id_2, Guid=id)  # -> out, A; inputs all_GUID: list of Guid, Guid: Guid
# ---------- c_script_2: C# ----------
    for(int i = 0;i < all_GUID.Count;i++)
    {
      if(all_GUID[i]==Guid)
        A = i;
    }
# ---------- end c_script_2 ----------
pt_2 = ConstructPoint(XCoordinate=0, YCoordinate=0, ZCoordinate=0)
series = Series(Start=Slider(3, range=0..10), Step=1, Count=10)
combine_4 = CombineData(Input0=reflay_2, Input1=场地外围线_default)  # -> Result, Index
number_slider = Slider(1, range=0..1)
crv_6 = Curve(combine_4.Result)
c_script_3 = CSharpScript(data=series, reset=Button(), index=c_script_2.A)  # -> out, A, B; inputs data: list of Int32, reset: Boolean, index: list of Int32
# ---------- c_script_3: C# ----------
    path++;
    A = DTree;

    if(reset)
    {
      path = 0;
      _data.Clear();
      DTree.Clear();
      return;
    }

    _data.Add(data);
    DTree.AddRange(data, new GH_Path(path));

    //    DataTree<int> tree = new DataTree<int>();
    //    for(int i = 0;i < _data.Count; i++)
    //    {
    //      int[] array = _data[i].Count;
    //      for(int j = 0;j < _data[i].Count;j++)
    //      {
    //
    //        array[j] = _data[i][j];
    //      }
    //    }

    //B = _data.Count;
# ---------- c_script_3: C# additional code ----------
  public static List<object> _data = new List<object>();
  public static DataTree<int> DTree = new DataTree<int>();
  int path = 0;
# ---------- end c_script_3 ----------
panel_9 = Panel(c_script_3.B)
data_rec_2 = PythonScript(x=Slider(2, range=0..10), enable=Toggle(True), reset=Button())  # -> x; inputs x: tree, enable: Boolean, reset: Boolean, limit: Int32
# ---------- data_rec_2: Python ----------
from Grasshopper import DataTree
if reset or 'rec' not in globals(): 
    rec = DataTree[object]()
if enable and not reset: 
    rec.MergeTree(x)
if limit > 0:
  for branch in rec.Branches:
    if branch.Count > limit:
      branch.RemoveRange(0, branch.Count - limit)
x = rec
# ---------- end data_rec_2 ----------
replace = ReplaceItems(List=dup, Item=get_values_3, Indices=c_script_2.A, Wrap=False)
crv_7 = Curve(<curve referenced from the Rhino model>)
graft = GraftTree(Tree=replace, IncludeEmptyLists=True, IncludeNullItems=True)
combine_5 = CombineData(Input1=dup)  # -> Result, Index
panel_10 = Panel(c_script_3.A)
data_rec_3 = PythonScript(enable=Toggle(True), reset=Button())  # -> x; inputs data: list, x: tree, enable: Boolean, reset: Boolean, limit: Int32
# ---------- data_rec_3: Python ----------
from Grasshopper import DataTree
if reset or 'rec' not in globals(): rec = DataTree[object]()
if enable and not reset: rec.MergeTree(x)
if limit > 0:
  for branch in rec.Branches:
    if branch.Count > limit:
      branch.RemoveRange(0, branch.Count - limit)

for i in x.AllData():
    data[i]=replace
x = data
# ---------- end data_rec_3 ----------
panel_11 = Panel(data_rec_3)

# ---- group: 寻找点与楼的关系
flatten_3 = FlattenTree(Tree=item.Item, Path="{0}")
crv_cp = CurveClosestPoint(Point=graft(flatten_3), Curve=flatten_2)  # -> Point, Parameter, Distance
sort = SortList(Keys=crv_cp.Distance, ValuesA=flatten_2)  # -> Keys, ValuesA
item_2 = ListItem(List=sort.ValuesA, Index=0, Wrap=True)
item_3 = ListItem(List=sort.Keys, Index=0, Wrap=True)
flatten_4 = FlattenTree(Tree=item_2, Path="{0}")
smaller = SmallerThan(FirstNumber=item_3, SecondNumber=Slider(0.01, range=0..0.01))  # -> SmallerThan, OrEqualTo
flatten_5 = FlattenTree(Tree=smaller.OrEqualTo, Path="{0}")
dispatch = Dispatch(List=flatten_3, DispatchPattern=flatten_5)  # -> ListA, ListB
dispatch_2 = Dispatch(List=flatten_4, DispatchPattern=flatten_5)  # -> ListA, ListB

# ----
pt_3 = Point(item.Item1)
主要道路 = Curve(crv_5)
主要道路宽度_2 = Number(主要道路宽度)
division = Division(A=主要道路宽度_2, B=2)
flatten_6 = FlattenTree(Tree=pt_3, Path="{0}")
crv_cp_2 = CurveClosestPoint(Point=graft(flatten_6), Curve=主要道路)  # -> Point, Parameter, Distance
外侧道路宽度_2 = Number(外侧道路宽度)
addition = Addition(A=division, B=Slider(2, range=0..10))
sort_2 = SortList(Keys=crv_cp_2.Distance, ValuesA=主要道路)  # -> Keys, ValuesA
item_4 = ListItem(List=sort_2.ValuesA, Index=0, Wrap=True)
scalebox_2 = ScaleBox(num=Slider(5, range=0..100), R=dispatch_2.ListA)
scalebox_3 = ScaleBox(num=Slider(4, range=0..10), R=楼栋平面)
offset = OffsetCurve(Curve=item_4, Distance=expr("-x", addition), Corners=1)
offset_2 = OffsetCurve(Curve=item_4, Distance=addition, Corners=1)
crv_cp_3 = CurveClosestPoint(Point=dispatch.ListA, Curve=scalebox_2)  # -> Point, Parameter, Distance
merge_2 = Merge(Data1=offset_2, Data2=offset)
crv_8 = Curve(scalebox_3)
graft_2 = GraftTree(Tree=flatten_6, IncludeEmptyLists=True, IncludeNullItems=True)
graft_3 = GraftTree(Tree=crv_cp_3.Point, IncludeEmptyLists=True, IncludeNullItems=True)
crv_cp_4 = CurveClosestPoint(Point=graft_3, Curve=merge_2)  # -> Point, Parameter, Distance
sort_3 = SortList(Keys=crv_cp_4.Distance, ValuesA=merge_2)  # -> Keys, ValuesA
item_5 = ListItem(List=sort_3.ValuesA, Index=0, Wrap=True)

# ---- group: 端点显示
cir = Circle(Plane=dispatch.ListA, Radius=Slider(5, range=0..10))
dash = DashPattern(Curve=cir, Pattern="1")  # -> Dashes, Gaps
previewlw = CustomPreviewLineweights(Geometry=dash.Dashes, Shader=ColourSwatch(SwatchColor=RGB(255, 55, 0)), Thickness=Slider(2, range=0..10), Absolute=False)

# ----
crv_cp_5 = CurveClosestPoint(Point=graft_2, Curve=item_5)  # -> Point, Parameter, Distance
pc = PathCreation(StartPoint=graft_3, EndPoint=crv_cp_5.Point, Obstacle=crv_8, Resolution=Slider(5, range=0..100), Orthogonal=Toggle(True))  # -> OutputPath, PathGrid
explode = Explode(Curve=pc.OutputPath, Recursive=True)  # -> Segments, Vertices
join = JoinCurves(Curves=explode.Segments, Preserve=False)
disc = Discontinuity(Curve=join, Level=1)  # -> Points, Parameters
场地外围线 = Curve(crv_6)
flatten_7 = FlattenTree(Tree=dispatch.ListA, Path="{0}")
rev = ReverseList(List=disc.Points)
graft_4 = GraftTree(Tree=flatten_7, IncludeEmptyLists=True, IncludeNullItems=True)
ins = InsertItems(List=rev, Item=graft_4, Indices=Slider(0, range=0..100), Wrap=True)
createatts = CreateAttributes(LayerName="连接道路线", enableFullPath=False)
ins_2 = InsertItems(List=ins, Item=graft_2, Indices="-1", Wrap=True)
number_slider_2 = Slider(5, range=0..10)

# ---- group: WIP
组团1 = Curve([<curve referenced from the Rhino model> x2])  # disabled
组团2 = Curve([<curve referenced from the Rhino model> x2])  # disabled
组团3 = Curve(<curve referenced from the Rhino model>)  # disabled
组团4 = Curve(<curve referenced from the Rhino model>)  # disabled
bbox = BoundingBox(Content=组团1, Plane=PlaneXY(0, 0, 0), UnionBox=True)  # -> Box, Box_2; disabled
bbox_2 = BoundingBox(Content=组团2, Plane=PlaneXY(0, 0, 0), UnionBox=True)  # -> Box, Box_2; disabled
bbox_3 = BoundingBox(Content=组团3, Plane=PlaneXY(0, 0, 0), UnionBox=True)  # -> Box, Box_2; disabled
bbox_4 = BoundingBox(Content=组团4, Plane=PlaneXY(0, 0, 0), UnionBox=True)  # -> Box, Box_2; disabled
entwine = Entwine(Branch00=bbox.Box, Branch01=bbox_2.Box, Branch02=bbox_3.Box, Branch03=bbox_4.Box, FlattenInputs=True)  # disabled
rec = Rectangle(entwine)  # disabled
场地外围线_2 = Curve(crv_6)  # disabled
addition_2 = Addition(A=number_slider_2, B=外侧道路宽度_2)  # disabled
offset_3 = OffsetCurve(Curve=场地外围线_2, Distance=expr("-x", addition_2), Corners=1)  # disabled
offset_4 = OffsetCurve(Curve=场地外围线_2, Distance=expr("-x", number_slider_2), Corners=1)  # disabled
bbox_5 = BoundingBox(Content=offset_4, Plane=PlaneXY(0, 0, 0), UnionBox=True)  # -> Box, Box_2; disabled
disc_2 = Discontinuity(Curve=rec, Level=1)  # -> Points, Parameters; disabled
c_script_4 = CSharpScript(Box=bbox_5.Box)  # -> A; inputs Box: Box; disabled
# ---------- c_script_4: C# ----------
    A = Box.Center;
# ---------- end c_script_4 ----------
dist = Distance(PointA=c_script_4, PointB=disc_2.Points)  # disabled
sort_4 = SortList(Keys=dist, ValuesA=disc_2.Points)  # -> Keys, ValuesA; disabled
number_slider_3 = Slider(3, range=0..10)  # disabled
item_6 = ListItem(List=sort_4.ValuesA, Index=0, Wrap=True)  # disabled
number_slider_4 = Slider(4, range=0..10)  # disabled
scale = Scale(Geometry=rec, Center=item_6, Factor=number_slider_3)  # -> Geometry, Transform; disabled
offset_5 = OffsetCurve(Curve=scale.Geometry, Distance=number_slider_4, Corners=1)  # disabled
flatten_8 = FlattenTree(Tree=offset_5, Path="{0}")  # disabled
rdiff = RegionDifference(CurvesA=offset_4, CurvesB=flatten_8)  # disabled
number_slider_5 = Slider(0.01, range=0..0.01)  # disabled
explode_2 = Explode(Curve=rdiff, Recursive=True)  # -> Segments, Vertices; disabled
midpt = CurveMiddle(Curve=explode_2.Segments)  # disabled
crv_cp_6 = CurveClosestPoint(Point=midpt, Curve=offset_4)  # -> Point, Parameter, Distance; disabled
smaller_2 = SmallerThan(FirstNumber=crv_cp_6.Distance, SecondNumber=number_slider_5)  # -> SmallerThan, OrEqualTo; disabled
dispatch_3 = Dispatch(List=explode_2.Segments, DispatchPattern=smaller_2.SmallerThan)  # -> ListA, ListB; disabled
crv_9 = Curve(dispatch_3.ListA)  # disabled
join_2 = JoinCurves(Curves=crv_9, Preserve=False)  # disabled
crv_10 = Curve(join_2)  # disabled
道路宽度 = Slider(6, range=0..10)  # disabled
number_slider_6 = Slider(5, range=0..10)  # disabled
avr = Average(Input=flatten(item_6))  # disabled
midpt_2 = CurveMiddle(Curve=crv_10)  # disabled
ln = Line(StartPoint=midpt_2, EndPoint=avr)  # disabled
与外围线连接的单一道路 = 与外围线连接的单一道路(T=ln, num=道路宽度, 外侧景观宽度=number_slider_2, 场地外围线=场地外围线_2, 外侧道路宽度=外侧道路宽度_2, 倒角半径=number_slider_6)  # disabled

# ---- group: WIP / 组团分割路
宽度 = Slider(5, range=0..10)  # disabled
padding = Slider(5, range=0..10)  # disabled
division_2 = Division(A=宽度, B=2)  # disabled
addition_3 = Addition(A=padding, B=division_2)  # disabled
number_slider_7 = Slider(4, range=0..10)  # disabled
offset_6 = OffsetCurve(Curve=rec, Distance=addition_3, Corners=1)  # disabled
division_3 = Division(A=padding, B=2)  # disabled
number_slider_8 = Slider(100, range=0..100)  # disabled
fillet = Fillet(Curve=offset_6, Radius=number_slider_7)  # disabled
offset_7 = OffsetCurve(Curve=fillet, Distance=expr("-x", division_3), Corners=1)  # disabled
offset_8 = OffsetCurve(Curve=fillet, Distance=division_3, Corners=1)  # disabled
crv_11 = Curve(offset_4)  # disabled
offset_9 = OffsetCurve(Curve=crv_11, Distance=number_slider_8, Corners=1)  # disabled
merge_3 = Merge(Data1=offset_8, Data2=offset_7)  # disabled
Z = UnitZ(Factor=1)  # disabled
boundary = BoundarySurfaces(Edges=flatten([crv_11, offset_9]))  # disabled
loft = Loft(Curves=merge_3, Options={Adjust=False, Closed=False, LoftEnds=0, LoftSimp=0, LoftType=0, Rebuild=10, Refit=0.01})  # disabled
move = Move(Geometry=boundary, Motion=Z)  # -> Geometry, Transform; disabled
multiplication = Multiplication(A=Z, B=-2)  # disabled
boundary_2 = BoundarySurfaces(Edges=flatten([offset_3, offset_4]))  # disabled
extr = Extrude(Base=move.Geometry, Direction=multiplication)  # disabled
trim = TrimSolid(Shape=loft, Cutters=extr)  # disabled
sunion = SolidUnion(Breps=flatten([trim, boundary_2]))  # disabled
edges = BrepEdges(Brep=sunion)  # -> Naked, Interior, NonManifold; disabled
number_slider_9 = Slider(2, range=0..10)  # disabled
area = Area(Geometry=rec)  # -> Area, Centroid; disabled
crv_12 = Curve(edges.Naked)  # disabled
sort_5 = SortList(Keys=flatten(area.Area))  # -> Keys, ValuesA; disabled
join_3 = JoinCurves(Curves=crv_12, Preserve=False)  # disabled
fillet_2 = Fillet(Curve=join_3, Radius=number_slider_9)  # disabled
item_7 = ListItem(List=sort_5.Keys, Index=0, Wrap=True)  # disabled
area_2 = Area(Geometry=fillet_2)  # -> Area, Centroid; disabled
smaller_3 = SmallerThan(FirstNumber=area_2.Area, SecondNumber=item_7)  # -> SmallerThan, OrEqualTo; disabled
dispatch_4 = Dispatch(List=fillet_2, DispatchPattern=smaller_3.OrEqualTo)  # -> ListA, ListB; disabled
crv_13 = Curve(dispatch_4.ListB)  # disabled
boundary_3 = BoundarySurfaces(Edges=flatten(crv_13))  # disabled

# ----
pline = PolyLine(Vertices=ins_2, Closed=False)
crv_14 = Curve([pline, crv_7])
number_slider_10 = Slider(1, range=0..1)
bake = BakeGeometry(Bake=Button(), Geometry=pline, Attributes=createatts, DeleteOldBakes=False, PreserveTrees=False)
cluster = Cluster_2(
    连接道路=reflay_3,
    外侧景观宽度=number_slider_2,
    场地外围线=场地外围线,
    外侧道路宽度=外侧道路宽度,
    unit=number_slider_10,
    轴线指定宽度=主要道路宽度,
    主要道路=crv_5,
    连接道路宽度=连接道路宽度,
    楼栋平面=flatten_2)  # -> plotboundary, outpath, outempty
cluster_2 = Cluster_2(
    连接道路=crv_14,
    外侧景观宽度=number_slider_2,
    场地外围线=场地外围线,
    外侧道路宽度=外侧道路宽度,
    unit=number_slider_10,
    轴线指定宽度=主要道路宽度,
    主要道路=crv_5,
    连接道路宽度=连接道路宽度,
    楼栋平面=flatten_2)  # -> plotboundary, outpath, outempty
srf = Surface(cluster.outpath)
道路 = Surface(cluster_2.outpath)
preview = CustomPreview(Geometry=道路, Material=ColourSwatch(SwatchColor=RGB(105, 105, 105)))
explode_3 = Explode(Curve=cluster_2.plotboundary, Recursive=True)  # -> Segments, Vertices
flatten_9 = FlattenTree(Tree=explode_3.Segments, Path="{0}")
graft_5 = GraftTree(Tree=flatten_9, IncludeEmptyLists=True, IncludeNullItems=True)
end = EndPoints(Curve=graft_5)  # -> Start, End
ln_2 = Line(StartPoint=end.Start, EndPoint=end.End)
midpt_3 = CurveMiddle(Curve=ln_2)
midpt_4 = CurveMiddle(Curve=graft_5)
dist_2 = Distance(PointA=midpt_4, PointB=midpt_3)
smaller_4 = SmallerThan(FirstNumber=dist_2, SecondNumber=0.01)  # -> SmallerThan, OrEqualTo
dispatch_5 = Dispatch(List=graft_5, DispatchPattern=smaller_4.OrEqualTo)  # -> ListA, ListB
darc = DeconstructArc(Arc=dispatch_5.ListB)  # -> BasePlane, Radius, Angle
midpt_5 = CurveMiddle(Curve=dispatch_5.ListB)
radialdim = DefineRadialDimension(Center=darc.BasePlane, Tip=midpt_5, DimensionPlane=PlaneXY(0, 0, 0), DimensionStyle="Default")
data = Data(radialdim)
环绕种植 = 环绕种植(
    随机程度=Slider(0.2, range=0..1),
    seed=Slider(5, range=0..10),
    C=cluster_2.plotboundary,
    树木基础半径=Slider(2, range=0..10),
    疏密度_0_1=Slider(0.4, range=0..1))
场地周边种植 = 场地周边种植(
    随机程度=Slider(0.6, range=0..1),
    seed=Slider(3, range=0..10),
    C=场地外围线,
    D=number_slider_2,
    树木基础半径=Slider(2, range=0..10),
    疏密度_0_1=Slider(0.5, range=0..1))
空地种植 = 空地种植(B_2=Slider(6.5, range=0..10), B=cluster_2.outempty)
circlemesh = CSharpScript(Circle=[环绕种植, 场地周边种植, 空地种植], Num=Slider(8, range=0..10))  # -> A; inputs Num: Int32
# ---------- circlemesh: C# ----------
    //double[] tL = Circle.DivideByCount(Num, true);
    Point3d[] pL;
    int n;
    if(Num == 0)
      n = 6;
    else
      n = Num;
    NurbsCurve crv = Circle.ToNurbsCurve();
    crv.DivideByCount(n, true, out pL);

    Mesh mesh = new Rhino.Geometry.Mesh();
    mesh.Vertices.Add(Circle.Center);
    foreach(Point3d p in pL)
    {
      mesh.Vertices.Add(p);
    }
    for(int i = 1;i < pL.Length;i++)
    {
      mesh.Faces.AddFace(0, i, i + 1);
    }
    mesh.Faces.AddFace(0, pL.Length, 1);


    A = mesh;
# ---------- end circlemesh ----------

# ---- group: Obsolete
道路生成 = 道路生成(楼栋平面=[<geometry referenced from the Rhino model> x2])  # -> R, S, C, outpath

# ==== cluster ScaleBox
num = ClusterInput()
R = ClusterInput()
num_2 = Number(num)
drec = DeconstuctRectangle(Rectangle=R)  # -> BasePlane, XInterval, YInterval
dedomain = DeconstructDomain(Domain=drec.XInterval)  # -> Start, End
dedomain_2 = DeconstructDomain(Domain=drec.YInterval)  # -> Start, End
subtraction = Subtraction(A=dedomain.Start, B=num_2)
addition = Addition(A=dedomain.End, B=num_2)
subtraction_2 = Subtraction(A=dedomain_2.Start, B=num_2)
addition_2 = Addition(A=dedomain_2.End, B=num_2)
dom = ConstructDomain(DomainStart=subtraction, DomainEnd=addition)
dom_2 = ConstructDomain(DomainStart=subtraction_2, DomainEnd=addition_2)
rectangle = Rectangle(Plane=drec.BasePlane, XSize=dom, YSize=dom_2, Radius=0)  # -> Rectangle, Length
R_2 = ClusterOutput(rectangle.Rectangle)

# ==== cluster 道路生成
unit = ClusterInput()
楼栋平面 = ClusterInput()
外侧道路宽度 = ClusterInput()
unit_2 = Number(unit)
combine = CombineData(Input0=外侧道路宽度, Input1=Slider(7, range=0..10))  # -> Result, Index
连接道路 = ClusterInput()
crv = ClusterInput()
外侧景观宽度 = ClusterInput()
multiplication = Multiplication(外围道路宽度=combine.Result, B=unit_2)
multiplication_2 = Multiplication(道路倒角半径=Slider(6, range=0..10), B=unit_2)
number_slider = Slider(0.4, range=0..1)
crv_2 = Curve(crv)
combine_2 = CombineData(Input0=外侧景观宽度, Input1=Slider(6, range=0..10))  # -> Result, Index
crv_3 = Curve(连接道路)
轴线指定宽度 = ClusterInput()
连接道路宽度 = ClusterInput()
指定轴线 = ClusterInput()
fillet = Fillet(Curve=crv_3, Radius=Slider(3, range=0..10))
连接道路_2 = Curve(fillet)
楼栋平面_2 = Curve(楼栋平面)

# ---- group: 在与楼栋平面相交处延长连接线，保证道路完整性
flatten = FlattenTree(Tree=连接道路_2, Path="{0}")
divide = DivideCurve(Curve=flatten, Count=Slider(1, range=0..1), Kinks=False)  # -> Points, Tangents, Parameters
graft = GraftTree(Tree=divide.Points, IncludeEmptyLists=True, IncludeNullItems=True)
crv_cp = CurveClosestPoint(Point=graft, Curve=楼栋平面_2)  # -> Point, Parameter, Distance
sort = SortList(Keys=crv_cp.Distance)  # -> Keys, ValuesA
item = ListItem(List=sort.Keys, Index=0, Wrap=True)
trim = TrimTree(Tree=item, Depth=1)
item_2 = ListItem(List=trim, Index=0, Wrap=True)
smaller = SmallerThan(FirstNumber=item_2, SecondNumber=Slider(0.1, range=0..0.1))  # -> SmallerThan, OrEqualTo
equals = Equality(FirstNumber=item_2, SecondNumber=0)  # -> Equality, Inequality
dispatch = Dispatch(List=flatten, DispatchPattern=flatten(smaller.SmallerThan))  # -> ListA, ListB
flip = FlipCurve(Curve=dispatch.ListB)  # -> Curve, Flag
entwine = Entwine(Branch00=dispatch.ListA, Branch01=flip.Curve, FlattenInputs=True)
flatten_2 = FlattenTree(Tree=entwine, Path="{0}")
ext = ExtendCurve(Curve=flatten_2, Type=0, Start=Slider(5, range=0..10), End=Slider(0, range=0..100))

# ----
offset = OffsetCurve(Curve=crv_2, Distance=expr("-x", combine_2.Result), Corners=1)
offset_2 = OffsetCurve(Curve=offset, Distance=expr("-x", multiplication), Corners=1)
轴线分割 = 轴线分割(_0=轴线指定宽度, 连接道路宽度=连接道路宽度, 轴线控制比例=number_slider, E=offset_2, crv=指定轴线)
ext_2 = ExtendCurve(Curve=fillet, Type=0, Start=Slider(0.5, range=0..1), End=Slider(0, range=0..100))
division = Division(A=连接道路宽度, B=2)
crv_4 = Curve(楼栋平面)
splitatcorners = SplitAtCorners(Poly=轴线分割, Angle=Slider(0.4, range=0..1))  # -> Corners, Parts
graft_2 = GraftTree(Tree=crv_4, IncludeEmptyLists=True, IncludeNullItems=True)
ccx = CurveCurve(CurveA=连接道路, CurveB=graft_2)  # -> Points, ParamsA, ParamsB
lng = ListLength(List=ccx.ParamsB)
pline = PolyLine(Vertices=splitatcorners.Corners, Closed=invert(False))
fillet_2 = Fillet(Curve=pline, Radius=multiplication_2)
fillet_3 = Fillet(Curve=offset_2, Radius=Slider(6, range=0..10))
轴线分割_2 = 轴线分割(连接道路=ext, _0=轴线指定宽度, 连接道路宽度=连接道路宽度, 轴线控制比例=number_slider, E=fillet_3, crv=指定轴线)

# ---- group: 楼栋平面修剪道路区域，并保证修剪后道路是闭合曲线
trim_2 = TrimWithRegions(Curve=轴线分割_2, Regions=楼栋平面_2)  # -> Inside, Outside
crv_5 = Curve(trim_2.Outside)
cls = Closed(Curve=crv_5)  # -> Closed, Periodic
dispatch_2 = Dispatch(List=crv_5, DispatchPattern=cls.Closed)  # -> ListA, ListB
end = EndPoints(Curve=dispatch_2.ListB)  # -> Start, End
ln = Line(StartPoint=end.Start, EndPoint=end.End)
merge = Merge(Data1=ln, Data2=dispatch_2.ListB)
join = JoinCurves(Curves=merge, Preserve=False)
merge_2 = Merge(Data1=simplify(join), Data2=simplify(dispatch_2.ListA))

# ---- group: 与楼栋交接处不倒角，其余地方正常倒角
crv_6 = Curve(reparameterize(merge_2))
disc = Discontinuity(Curve=crv_6, Level=1)  # -> Points, Parameters
flatten_3 = FlattenTree(Tree=disc.Points, Path="{0}")
crv_cp_2 = CurveClosestPoint(Point=graft(flatten_3), Curve=flatten(楼栋平面_2))  # -> Point, Parameter, Distance
sort_2 = SortList(Keys=crv_cp_2.Distance)  # -> Keys, ValuesA
item_3 = ListItem(List=sort_2.Keys, Index=0, Wrap=True)
smaller_2 = SmallerThan(FirstNumber=item_3, SecondNumber=Slider(0.1, range=0..0.1))  # -> SmallerThan, OrEqualTo
flatten_4 = FlattenTree(Tree=smaller_2.SmallerThan, Path="{0}")
unflatten = UnflattenTree(Tree=flatten_4, Guide=disc.Parameters)
dispatch_3 = Dispatch(List=disc.Parameters, DispatchPattern=unflatten)  # -> ListA, ListB
fillet_4 = Fillet(Curve=crv_6, Parameter=dispatch_3.ListB, Radius=Slider(3, range=0..10))  # -> Curve, Parameter
crv_7 = Curve(fillet_4.Curve)
multiplecrv_booleanintersection = CSharpScript(crv=crv_7)  # -> out, A; inputs crv: list of Curve
# ---------- multiplecrv_booleanintersection: C# ----------
    //Curve[] curves = new Curve[crv.Count];
    Curve finalCrv = crv[0];
    for(int i = 1;i < crv.Count;i++)
    {
      //curves[i] = crv[i];
      Curve[] curves = Curve.CreateBooleanIntersection(finalCrv, crv[i],0.001);
      if(curves.Length < 2)
      {
        finalCrv = curves[0];
      }
    }
    A = finalCrv;
# ---------- end multiplecrv_booleanintersection ----------
crv_8 = Curve(offset)
boundary = BoundarySurfaces(Edges=flatten([crv_8, multiplecrv_booleanintersection.A]))

# ----
equals_2 = Equality(FirstNumber=lng, SecondNumber=0)  # -> Equality, Inequality
dispatch_4 = Dispatch(List=graft_2, DispatchPattern=equals_2.Inequality)  # -> ListA, ListB
offset_3 = OffsetCurve(Curve=ext_2, Distance=expr("-x", division), Corners=1)
offset_4 = OffsetCurve(Curve=ext_2, Distance=division, Corners=1)
Z = UnitZ(Factor=1)
Z_2 = UnitZ(Factor=1)
boundary_2 = BoundarySurfaces(Edges=fillet_2)
flatten_5 = FlattenTree(Tree=dispatch_4.ListA, Path="{0}")
boundary_3 = BoundarySurfaces(Edges=flatten_5)
panel = Panel(merge_2)
multiplication_3 = Multiplication(A=Z_2, B=-2)
loft = Loft(
    Curves=[offset_4, offset_3],
    Options={Adjust=False, Closed=False, LoftEnds=0, LoftSimp=0, LoftType=0, Rebuild=10, Refit=0.01})
multiplication_4 = Multiplication(A=Z, B=-2)
entwine_2 = Entwine(Branch00=loft, Branch01=boundary_3, FlattenInputs=True)  # -> flatten(Result)
move = Move(Geometry=boundary_3, Motion=Z)  # -> Geometry, Transform
move_2 = Move(Geometry=entwine_2, Motion=Z)  # -> Geometry, Transform
extr = Extrude(Base=move.Geometry, Direction=multiplication_4)
extr_2 = Extrude(Base=move_2.Geometry, Direction=multiplication_4)
C = ClusterOutput(fillet_2)
boundary_4 = BoundarySurfaces(Edges=crv_2)
flatten_6 = FlattenTree(Tree=boundary_2, Path="{0}")
trim_3 = TrimSolid(Shape=flatten_6, Cutters=flatten(extr_2))
edges = BrepEdges(Brep=trim_3)  # -> Naked, Interior, NonManifold
join_2 = JoinCurves(Curves=edges.Naked, Preserve=False)
divlength = DivideLength(Curve=join_2, Length=Slider(1.8, range=0..10))  # -> Points, Tangents, Parameters
pline_2 = PolyLine(Vertices=divlength.Points, Closed=False)
splitatcorners_2 = SplitAtCorners(Poly=pline_2, Angle=Slider(0.09, range=0..1))  # -> Corners, Parts
panel_2 = Panel(trim_3)
pline_3 = PolyLine(Vertices=splitatcorners_2.Corners, Closed=invert(False))
outpath = ClusterOutput(boundary)
fillet_5 = Fillet(Curve=pline_3, Radius=Slider(1, range=0..10))
boundary_5 = BoundarySurfaces(Edges=fillet_5)
move_3 = Move(Geometry=boundary_5, Motion=Z_2)  # -> Geometry, Transform
extr_3 = Extrude(Base=move_3.Geometry, Direction=multiplication_3)
S = ClusterOutput(boundary_5)
flatten_7 = FlattenTree(Tree=extr_3, Path="{0}")
trim_4 = TrimSolid(Shape=boundary_4, Cutters=flatten_7)  # disabled
boundary_6 = BoundarySurfaces(Edges=flatten([boundary_5, offset]))
trim_5 = TrimSolid(Shape=boundary_6, Cutters=extr)
R = ClusterOutput(trim_5)

# ==== cluster 场地周边种植
疏密度_0_1 = ClusterInput()
树木基础半径 = ClusterInput()
C = ClusterInput()
D = ClusterInput()
combine = CombineData(Input0=疏密度_0_1, Input1=Slider(0, range=0..1))  # -> Result, Index
combine_2 = CombineData(Input0=树木基础半径, Input1=Slider(2, range=0..10))  # -> Result, Index
number_slider = Slider(0.2, range=0..1)
offset = OffsetCurve(Curve=C, Distance=expr("-x/2", D), Corners=0)
随机程度 = ClusterInput()
seed = ClusterInput()
multiplication = Multiplication(A=combine_2.Result, B=2)
addition = Addition(A=combine.Result, B=1)
combine_3 = CombineData(Input0=随机程度, Input1=number_slider)  # -> Result, Index
combine_4 = CombineData(Input0=随机程度, Input1=number_slider)  # -> Result, Index
multiplication_2 = Multiplication(A=multiplication, B=addition)
subtraction = Subtraction(A=1, B=combine_4.Result)
addition_2 = Addition(A=combine_3.Result, B=1)
divlength = DivideLength(Curve=offset, Length=multiplication_2)  # -> Points, Tangents, Parameters
expression = Expression(x=combine_2.Result, y=subtraction, Expression="x*y")
expression_2 = Expression(x=combine_2.Result, y=addition_2, Expression="x*y")
expression_3 = Expression(x=D, Expression="x/2*1.5")
lng = ListLength(List=divlength.Points)
dom = ConstructDomain(DomainStart=expression, DomainEnd=expression_2)
c_script = CSharpScript(x=随机程度)  # -> A; inputs x: Double
# ---------- c_script: C# ----------
    A = (x == null || x == 0);
# ---------- end c_script ----------
random = Random(Range=dom, Number=lng, Seed=seed)
filter = StreamFilter(Gate=c_script, Stream0=random, Stream1=combine_2.Result)
c_script_2 = CSharpScript(x=filter, y=expression_3)  # -> out, A; inputs x: Double, y: Double
# ---------- c_script_2: C# ----------
    if(x >= y)
      A = y;
    else
      A = x;
# ---------- end c_script_2 ----------
cir = Circle(Plane=divlength.Points, Radius=c_script_2.A)
outputtrees = ClusterOutput(cir)

# ==== cluster 环绕种植
树木基础半径 = ClusterInput()
疏密度_0_1 = ClusterInput()
combine = CombineData(Input0=树木基础半径, Input1=Slider(2, range=0..10))  # -> Result, Index
combine_2 = CombineData(Input0=疏密度_0_1, Input1=Slider(0, range=0..1))  # -> Result, Index
multiplication = Multiplication(A=combine.Result, B=2)
number_slider = Slider(0.2, range=0..1)
addition = Addition(A=combine_2.Result, B=1)
随机程度 = ClusterInput()
seed = ClusterInput()
C = ClusterInput()
multiplication_2 = Multiplication(A=multiplication, B=addition)
divlength = DivideLength(Curve=C, Length=multiplication_2)  # -> Points, Tangents, Parameters
combine_3 = CombineData(Input0=随机程度, Input1=number_slider)  # -> Result, Index
combine_4 = CombineData(Input0=随机程度, Input1=number_slider)  # -> Result, Index
subtraction = Subtraction(A=1, B=combine_4.Result)
addition_2 = Addition(A=combine_3.Result, B=1)
expression = Expression(x=combine.Result, y=subtraction, Expression="x*y")
expression_2 = Expression(x=combine.Result, y=addition_2, Expression="x*y")
lng = ListLength(List=divlength.Points)
expression_3 = Expression(x=combine.Result, Expression="x*1.5")
dom = ConstructDomain(DomainStart=expression, DomainEnd=expression_2)
c_script = CSharpScript(x=随机程度)  # -> A; inputs x: Double; same code as c_script
random = Random(Range=dom, Number=lng, Seed=seed)
filter = StreamFilter(Gate=c_script, Stream0=random, Stream1=combine.Result)
c_script_2 = CSharpScript(x=filter, y=expression_3)  # -> out, A; inputs x: Double, y: Double; same code as c_script_2
cir = Circle(Plane=divlength.Points, Radius=c_script_2.A)
outputtrees = ClusterOutput(cir)

# ==== cluster 空地种植
custom_mesh_settings = SettingsCustom(
    StitchSeams=True,
    SimplePlanes=False,
    Refine=True,
    MinCount=16,
    MaxCount=400,
    AspectRatio=20,
    MaxDistance=0,
    MaxAngle=20,
    MinEdge=0,
    MaxEdge=0)
B = ClusterInput()
mesh = MeshBrep(Brep=B, Settings=custom_mesh_settings)
mesh_2 = Mesh(mesh)
tri = Triangulate(Mesh=mesh_2)  # -> Mesh, Count
faceb = FaceBoundaries(Mesh=tri.Mesh)
explode = Explode(Curve=faceb, Recursive=True)  # -> Segments, Vertices
len = Length(Curve=explode.Segments)
sort = SortList(Keys=len, ValuesA=explode.Segments)  # -> Keys, ValuesA
B_2 = ClusterInput()
item = ListItem(List=sort.ValuesA, Index=0, Wrap=True)
larger = LargerThan(FirstNumber=item, SecondNumber=B_2)  # -> LargerThan, OrEqualTo
flatten = FlattenTree(Tree=faceb, Path="{0}")
flatten_2 = FlattenTree(Tree=larger.LargerThan, Path="{0}")
dispatch = Dispatch(List=flatten, DispatchPattern=flatten_2)  # -> ListA, ListB
crv = Curve(dispatch.ListA)
disc = Discontinuity(Curve=crv, Level=1)  # -> Points, Parameters
item_2 = ListItem(List=disc.Points, Index=0, Wrap=True)  # -> Item, Item1, Item2
incircle = InCircle(CornerA=item_2.Item, CornerB=item_2.Item1, CornerC=item_2.Item2)  # -> Circle, Plane, Radius
clean = CleanTree(RemoveNulls=True, RemoveInvalid=True, RemoveEmpty=False, Tree=flatten(incircle.Circle))
circle = Circle(clean)
circle_2 = ClusterOutput(circle)

# ==== cluster 与外围线连接的单一道路
T = ClusterInput()
外侧景观宽度 = ClusterInput()
flatten = FlattenTree(Tree=T, Path="{0}")
场地外围线 = ClusterInput()
外侧景观宽度_2 = Number(外侧景观宽度)
divide = DivideCurve(Curve=flatten, Count=1, Kinks=False)  # -> Points, Tangents, Parameters
场地外围线_2 = Curve(场地外围线)
num = ClusterInput()
外侧道路宽度 = ClusterInput()
area = Area(Geometry=场地外围线_2)  # -> Area, Centroid
num_2 = Number(num)
offset = OffsetCurve(Curve=场地外围线_2, Distance=expr("-x", 外侧景观宽度_2), Corners=1)
dist = Distance(PointA=divide.Points, PointB=area.Centroid)
sort = SortList(Keys=dist, ValuesA=divide.Points)  # -> Keys, ValuesA
division = Division(A=num_2, B=2)
addition = Addition(外侧景观宽度=外侧景观宽度_2, 外侧道路宽度=外侧道路宽度)
item = ListItem(List=sort.ValuesA, Index=0, Wrap=True)  # -> Item, Item1
ln = Line(StartPoint=item.Item1, EndPoint=item.Item)
offset_2 = OffsetCurve(Curve=场地外围线_2, Distance=expr("-x", addition), Corners=1)
flatten_2 = FlattenTree(Tree=ln, Path="{0}")
ext = ExtendCurve(Curve=flatten_2, Type=0, Start=Slider(10, range=0..10), End=0)
offset_3 = OffsetCurve(Curve=ext, Distance=expr("-x", division), Corners=1)
offset_4 = OffsetCurve(Curve=ext, Distance=division, Corners=1)
merge = Merge(Data1=offset_4, Data2=offset_3)
loft = Loft(Curves=merge, Options={Adjust=False, Closed=False, LoftEnds=0, LoftSimp=0, LoftType=0, Rebuild=10, Refit=0.01})
倒角半径 = ClusterInput()
rdiff = RegionDifference(CurvesA=offset_2, CurvesB=flatten(loft))
倒角半径_2 = Number(倒角半径)
fillet = Fillet(Curve=rdiff, Radius=倒角半径_2)
fillet_2 = Fillet(Curve=offset, Radius=倒角半径_2)
boundary = BoundarySurfaces(Edges=flatten([fillet, fillet_2]))
outputpath = ClusterOutput(boundary)

# ==== cluster Cluster_2
unit = ClusterInput()
外侧道路宽度 = ClusterInput()
combine = CombineData(Input0=unit, Input1=Slider(1, range=0..1))  # -> Result, Index
combine_2 = CombineData(Input0=外侧道路宽度, Input1=Slider(7, range=0..10))  # -> Result, Index
unit_2 = Number(combine.Result)
场地外围线 = ClusterInput()
外侧景观宽度 = ClusterInput()
multiplication = Multiplication(外围道路宽度=combine_2.Result, B=unit_2)
crv = Curve(场地外围线)
combine_3 = CombineData(Input0=外侧景观宽度, Input1=Slider(6, range=0..10))  # -> Result, Index
轴线指定宽度 = ClusterInput()
连接道路宽度 = ClusterInput()
连接道路 = ClusterInput()
主要道路 = ClusterInput()
offset = OffsetCurve(Curve=crv, Distance=expr("-x", combine_3.Result), Corners=1)
offset_2 = OffsetCurve(Curve=offset, Distance=expr("-x", multiplication), Corners=1)
fillet = Fillet(Curve=offset_2, Radius=Slider(6, range=0..10))
crv_2 = Curve(连接道路)
楼栋平面 = ClusterInput()
楼栋平面_2 = Curve(楼栋平面)

# ---- group: 在与楼栋平面相交处延长连接线，保证道路完整性
flatten = FlattenTree(Tree=crv_2, Path="{0}")
divide = DivideCurve(Curve=flatten, Count=Slider(1, range=0..1), Kinks=False)  # -> Points, Tangents, Parameters
graft = GraftTree(Tree=divide.Points, IncludeEmptyLists=True, IncludeNullItems=True)
crv_cp = CurveClosestPoint(Point=graft, Curve=楼栋平面_2)  # -> Point, Parameter, Distance
sort = SortList(Keys=crv_cp.Distance)  # -> Keys, ValuesA
item = ListItem(List=sort.Keys, Index=0, Wrap=True)
trim = TrimTree(Tree=item, Depth=1)
item_2 = ListItem(List=trim, Index=0, Wrap=True)
smaller = SmallerThan(FirstNumber=item_2, SecondNumber=Slider(0.1, range=0..0.1))  # -> SmallerThan, OrEqualTo
equals = Equality(FirstNumber=item_2, SecondNumber=0)  # -> Equality, Inequality
dispatch = Dispatch(List=flatten, DispatchPattern=flatten(smaller.SmallerThan))  # -> ListA, ListB
flip = FlipCurve(Curve=dispatch.ListB)  # -> Curve, Flag
entwine = Entwine(Branch00=dispatch.ListA, Branch01=flip.Curve, FlattenInputs=True)
flatten_2 = FlattenTree(Tree=entwine, Path="{0}")
ext = ExtendCurve(Curve=flatten_2, Type=0, Start=Slider(5, range=0..10), End=Slider(0, range=0..100))

# ----
Z = UnitZ(Factor=1)
multiplication_2 = Multiplication(A=Z, B=-2)
move = Move(Geometry=楼栋平面_2, Motion=Z)  # -> Geometry, Transform
boundary = BoundarySurfaces(Edges=move.Geometry)
extr = Extrude(Base=boundary, Direction=multiplication_2)
fillet_2 = Fillet(Curve=ext, Radius=Slider(3, range=0..10))
主路分块 = 主路分块(连接道路=fillet_2, 连接道路宽度=连接道路宽度, _0=轴线指定宽度, E=fillet, crv=主要道路)  # -> 地块环线, T

# ---- group: 楼栋平面修剪道路区域，并保证修剪后道路是闭合曲线
trim_2 = TrimWithRegions(Curve=主路分块.T, Regions=楼栋平面_2)  # -> Inside, Outside; disabled
crv_3 = Curve(trim_2.Outside)  # disabled
cls = Closed(Curve=crv_3)  # -> Closed, Periodic; disabled
dispatch_2 = Dispatch(List=crv_3, DispatchPattern=cls.Closed)  # -> ListA, ListB; disabled
end = EndPoints(Curve=dispatch_2.ListB)  # -> Start, End; disabled
ln = Line(StartPoint=end.Start, EndPoint=end.End)  # disabled
merge = Merge(Data1=ln, Data2=dispatch_2.ListB)  # disabled
join = JoinCurves(Curves=merge, Preserve=False)  # disabled
merge_2 = Merge(Data1=simplify(join), Data2=simplify(dispatch_2.ListA))  # disabled

# ----
crv_4 = Curve(offset)
plotboundary = ClusterOutput(主路分块.地块环线)
boundary_2 = BoundarySurfaces(Edges=flatten([主路分块.T, crv_4]))
trim_3 = TrimSolid(Shape=boundary_2, Cutters=extr)
edges = BrepEdges(Brep=trim_3)  # -> Naked, Interior, NonManifold
join_2 = JoinCurves(Curves=edges.Naked, Preserve=False)
flatten_3 = FlattenTree(Tree=join_2, Path="{0}")
area = Area(Geometry=crv_4)  # -> Area, Centroid
area_2 = Area(Geometry=flatten_3)  # -> Area, Centroid
similar = Similarity(FirstNumber=area.Area, SecondNumber=area_2.Area, Threshold=0.1)  # -> Similarity, AbsoluteDifference
dispatch_3 = Dispatch(List=flatten_3, DispatchPattern=similar.Similarity)  # -> ListA, ListB
graft_2 = GraftTree(Tree=dispatch_3.ListB, IncludeEmptyLists=True, IncludeNullItems=True)

# ---- group: 与楼栋交接处不倒角，其余地方正常倒角
crv_5 = Curve(reparameterize(graft_2))
disc = Discontinuity(Curve=crv_5, Level=1)  # -> Points, Parameters
flatten_4 = FlattenTree(Tree=disc.Points, Path="{0}")
crv_cp_2 = CurveClosestPoint(Point=graft(flatten_4), Curve=flatten(楼栋平面_2))  # -> Point, Parameter, Distance
sort_2 = SortList(Keys=crv_cp_2.Distance)  # -> Keys, ValuesA
item_3 = ListItem(List=sort_2.Keys, Index=0, Wrap=True)
smaller_2 = SmallerThan(FirstNumber=item_3, SecondNumber=Slider(0.1, range=0..0.1))  # -> SmallerThan, OrEqualTo
flatten_5 = FlattenTree(Tree=smaller_2.SmallerThan, Path="{0}")
unflatten = UnflattenTree(Tree=flatten_5, Guide=disc.Parameters)
dispatch_4 = Dispatch(List=disc.Parameters, DispatchPattern=unflatten)  # -> ListA, ListB
fillet_3 = Fillet(Curve=crv_5, Parameter=dispatch_4.ListB, Radius=Slider(3, range=0..10))  # -> Curve, Parameter
crv_6 = Curve(fillet_3.Curve)
multiplecrv_booleanintersection = CSharpScript(crv=crv_6)  # -> out, A; inputs crv: list of Curve; same code as multiplecrv_booleanintersection
crv_7 = Curve(offset)
boundary_3 = BoundarySurfaces(Edges=flatten([crv_7, multiplecrv_booleanintersection.A]))

# ----
rdiff = RegionDifference(CurvesA=multiplecrv_booleanintersection.A, CurvesB=楼栋平面_2)
boundary_4 = BoundarySurfaces(Edges=flatten(rdiff))
outempty = ClusterOutput(boundary_4)
outpath = ClusterOutput(boundary_3)

# ==== cluster 警告
bounds = GetViewportBoundaryDimensions(Refresh=True, Origin=Point(0, 0, 0), Scale=0.25, xDim=1614, yDim=809)
pcen = PolygonCenter(Polyline=bounds)  # -> CenterV, CenterE, CenterA
vec2pt = Vector2Pt(PointA=pcen.CenterV, PointB="{0,0,0}", Unitize=False)  # -> Vector, Length
move = Move(Geometry=bounds, Motion=vec2pt.Vector)  # -> Geometry, Transform
height = ClusterInput()
scale = Scale(Geometry=move.Geometry, Center=Point(0, 0, 0), Factor=Slider(0.1, range=0..1))  # -> Geometry, Transform
text = ClusterInput()
G = ClusterOutput(move.Geometry)
font = ConduitFont(
    Font="Arial",
    TextHeight=height,
    AdaptiveHeight=True,
    TextSpacing=1.15,
    Alignment=Slider(1, range=0..1),
    Bold=invert(False),
    Italic=False,
    Color=RGB(0, 0, 0))
hud_text = DrawText(
    Boundary=scale.Geometry,
    Text=text,
    TextOrdering=1,
    TextDistribution=Slider(1, range=0..1),
    ColorOverride=RGB(255, 0, 0),
    OrientVertically=False,
    CustomFont=font)
drawobjs = ClusterOutput(hud_text)

# ==== cluster 轴线分割: 沿轴线将场地进行初步分割; 可以分别调整y轴正负方向的偏移量
crv = ClusterInput()
E = ClusterInput()
crv_2 = Curve(crv)
graft = GraftTree(Tree=crv_2, IncludeEmptyLists=True, IncludeNullItems=True)
item = ListItem(List=graft, Index=0, Wrap=True)

# ---- group: 判定是否更趋向于x轴
end = EndPoints(Curve=graft)  # -> Start, End
vec2pt = Vector2Pt(PointA=end.Start, PointB=end.End, Unitize=False)  # -> Vector, Length
X = UnitX(Factor=1)
rev = Reverse(Vector=X)
angle = Angle(VectorA=vec2pt.Vector, VectorB=rev)  # -> Angle, Reflex
angle_2 = Angle(VectorA=vec2pt.Vector, VectorB=X)  # -> Angle, Reflex
pi = Pi(Factor=Slider(0.25, range=0..1))
smaller = SmallerThan(FirstNumber=angle_2.Angle, SecondNumber=pi)  # -> SmallerThan, OrEqualTo
smaller_2 = SmallerThan(FirstNumber=angle.Angle, SecondNumber=pi)  # -> SmallerThan, OrEqualTo
or = GateOr(A=smaller.SmallerThan, B=smaller_2.SmallerThan)

# ---- group: 确定x，y轴的避让距离
bbox = BoundingBox(Content=E, Plane=PlaneXY(0, 0, 0))  # -> Box, Box_2
底面边界 = 底面边界(B=bbox.Box, G=0)
cluster = Cluster(C=底面边界, axis="x")
cluster_2 = Cluster(C=底面边界, axis="y")
number_slider = Slider(5, range=0..10)
division = Division(A=cluster, B=number_slider)
division_2 = Division(A=cluster_2, B=number_slider)
X_2 = UnitX(Factor=1)
Y = UnitY(Factor=1)
contour = Contour(Shape=E, Point=Point(0, 0, 0), Direction=X_2, Distance=division)
contour_2 = Contour(Shape=E, Point=Point(0, 0, 0), Direction=Y, Distance=division_2)
len = Length(Curve=contour)  # -> flatten(Length)
len_2 = Length(Curve=contour_2)  # -> flatten(Length)
number_slider_2 = Slider(15, range=0..100)
avr = Average(Input=len)
avr_2 = Average(Input=len_2)
division_3 = Division(A=avr, B=number_slider_2)
division_4 = Division(A=avr_2, B=number_slider_2)

# ----
dispatch = Dispatch(List=graft, DispatchPattern=or)  # -> ListA, ListB
boundary = BoundarySurfaces(Edges=E)
轴线控制比例 = ClusterInput()  # 用于控制道路与实际排布地块，最高为1，用于道路时适当降低
y轴方向避让距离 = Number(division_3)
x轴方向避让距离 = Number(division_4)
_0 = ClusterInput()
multiplication = Multiplication(A=轴线控制比例, B=x轴方向避让距离)
multiplication_2 = Multiplication(A=轴线控制比例, B=y轴方向避让距离)
combine = CombineData(Input0=_0, Input1=multiplication_2)  # -> Result, Index
combine_2 = CombineData(Input0=_0, Input1=multiplication)  # -> Result, Index
num = Number(combine_2.Result)
num_2 = Number(combine.Result)

# ---- group: 判断线段偏移正负方向，y轴负方向会偏移更多
midpt = CurveMiddle(Curve=dispatch.ListA)
crv_cp = CurveClosestPoint(Point=midpt, Curve=dispatch.ListA)  # -> Point, Parameter, Distance
hframe = HorizontalFrame(Curve=dispatch.ListA, Parameter=crv_cp.Parameter)
deplane = DeconstructPlane(Plane=hframe)  # -> Origin, XAxis, YAxis, ZAxis
c_script = CSharpScript(Vec=deplane.YAxis)  # -> yPositive, yNegative; inputs Vec: Vector3d
# ---------- c_script: C# ----------
    Vector3d yVec = new Vector3d(0, 1, 0);
    if(Vec * yVec > 0)
    {
      yPositive = Vec;
      yNegative = -Vec;
    }
    if(Vec * yVec < 0)
    {
      yPositive = -Vec;
      yNegative = Vec;
    }
# ---------- end c_script ----------
pl = ConstructPlane(Origin=deplane.Origin, XAxis=deplane.XAxis, YAxis=c_script.yNegative)
pl_2 = ConstructPlane(Origin=deplane.Origin, XAxis=deplane.XAxis, YAxis=c_script.yPositive)
multiplication_3 = Multiplication(A=Slider(1, range=0..10), B=num_2)
offset = OffsetCurve(Curve=dispatch.ListA, Distance=num_2, Plane=pl, Corners=1)
offset_2 = OffsetCurve(Curve=dispatch.ListA, Distance=multiplication_3, Plane=pl_2, Corners=1)

# ----
offset_3 = OffsetCurve(Curve=dispatch.ListB, Distance=expr("-x", num), Corners=1)
offset_4 = OffsetCurve(Curve=dispatch.ListB, Distance=num, Corners=1)
simplify = SimplifyTree(Tree=offset, Front=False)
simplify_2 = SimplifyTree(Tree=offset_2, Front=False)
连接道路宽度 = ClusterInput()
simplify_3 = SimplifyTree(Tree=offset_4, Front=False)
simplify_4 = SimplifyTree(Tree=offset_3, Front=False)
连接道路 = ClusterInput()
division_5 = Division(A=连接道路宽度, B=2)
merge = Merge(Data1=simplify_3, Data2=simplify_4, Data3=simplify, Data4=simplify_2)
combine_3 = CombineData(Input0=division_5, Input1=Slider(1.5, range=0..10))  # -> Result, Index
clean = CleanTree(RemoveNulls=True, RemoveInvalid=True, RemoveEmpty=False, Tree=merge)
offset_5 = OffsetCurve(Curve=连接道路, Distance=expr("-x", combine_3.Result), Corners=1)
offset_6 = OffsetCurve(Curve=连接道路, Distance=combine_3.Result, Corners=1)
Z = UnitZ(Factor=1)
loft = Loft(Curves=clean, Options={Adjust=False, Closed=False, LoftEnds=0, LoftSimp=0, LoftType=0, Rebuild=10, Refit=0.01})
merge_2 = Merge(Data1=offset_6, Data2=offset_5)
panel = Panel(clean)
multiplication_4 = Multiplication(A=Z, B="-2")
loft_2 = Loft(Curves=merge_2, Options={Adjust=False, Closed=False, LoftEnds=0, LoftSimp=0, LoftType=0, Rebuild=10, Refit=0.01})
entwine = Entwine(Branch00=loft_2, Branch01=loft, FlattenInputs=True)
move = Move(Geometry=entwine, Motion=Z)  # -> Geometry, Transform
extr = Extrude(Base=move.Geometry, Direction=multiplication_4)
flatten = FlattenTree(Tree=extr, Path="{0}")
clean_2 = CleanTree(RemoveNulls=True, RemoveInvalid=True, RemoveEmpty=False, Tree=flatten)
trim = TrimSolid(Shape=boundary, Cutters=clean_2)
edges = BrepEdges(Brep=trim)  # -> Naked, Interior, NonManifold
join = JoinCurves(Curves=edges.Naked, Preserve=False)
simplify_5 = SimplifyTree(Tree=join, Front=False)
T = ClusterOutput(simplify_5)

# ==== cluster 主路分块: 沿轴线将场地进行初步分割; 可以分别调整y轴正负方向的偏移量
crv = ClusterInput()
E = ClusterInput()
crv_2 = Curve(crv)
graft = GraftTree(Tree=crv_2, IncludeEmptyLists=True, IncludeNullItems=True)
item = ListItem(List=graft, Index=0, Wrap=True)

# ---- group: 判定是否更趋向于x轴
end = EndPoints(Curve=graft)  # -> Start, End
vec2pt = Vector2Pt(PointA=end.Start, PointB=end.End, Unitize=False)  # -> Vector, Length
X = UnitX(Factor=1)
rev = Reverse(Vector=X)
angle = Angle(VectorA=vec2pt.Vector, VectorB=rev)  # -> Angle, Reflex
angle_2 = Angle(VectorA=vec2pt.Vector, VectorB=X)  # -> Angle, Reflex
pi = Pi(Factor=Slider(0.25, range=0..1))
smaller = SmallerThan(FirstNumber=angle_2.Angle, SecondNumber=pi)  # -> SmallerThan, OrEqualTo
smaller_2 = SmallerThan(FirstNumber=angle.Angle, SecondNumber=pi)  # -> SmallerThan, OrEqualTo
or = GateOr(A=smaller.SmallerThan, B=smaller_2.SmallerThan)

# ---- group: 确定x，y轴的避让距离
bbox = BoundingBox(Content=E, Plane=PlaneXY(0, 0, 0))  # -> Box, Box_2; disabled
底面边界 = 底面边界(B=bbox.Box, G=0)  # disabled
panel = Panel("x")  # disabled
panel_2 = Panel("y")  # disabled
cluster = Cluster(C=底面边界, axis=panel)  # disabled
cluster_2 = Cluster(C=底面边界, axis=panel_2)  # disabled
number_slider = Slider(5, range=0..10)  # disabled
division = Division(A=cluster, B=number_slider)  # disabled
division_2 = Division(A=cluster_2, B=number_slider)  # disabled
X_2 = UnitX(Factor=1)  # disabled
Y = UnitY(Factor=1)  # disabled
contour = Contour(Shape=E, Point=Point(0, 0, 0), Direction=X_2, Distance=division)  # disabled
contour_2 = Contour(Shape=E, Point=Point(0, 0, 0), Direction=Y, Distance=division_2)  # disabled
len = Length(Curve=contour)  # -> flatten(Length); disabled
len_2 = Length(Curve=contour_2)  # -> flatten(Length); disabled
number_slider_2 = Slider(15, range=0..100)  # disabled
avr = Average(Input=len)  # disabled
avr_2 = Average(Input=len_2)  # disabled
division_3 = Division(A=avr, B=number_slider_2)  # disabled
division_4 = Division(A=avr_2, B=number_slider_2)  # disabled

# ----
dispatch = Dispatch(List=graft, DispatchPattern=or)  # -> ListA, ListB
boundary = BoundarySurfaces(Edges=E)
_0 = ClusterInput()
combine = CombineData(Input0=_0, Input1=Slider(5, range=0..10))  # -> Result, Index
division_5 = Division(A=combine.Result, B=2)
num = Number(division_5)
num_2 = Number(division_5)

# ---- group: 判断线段偏移正负方向，y轴负方向会偏移更多
midpt = CurveMiddle(Curve=dispatch.ListA)
crv_cp = CurveClosestPoint(Point=midpt, Curve=dispatch.ListA)  # -> Point, Parameter, Distance
hframe = HorizontalFrame(Curve=dispatch.ListA, Parameter=crv_cp.Parameter)
deplane = DeconstructPlane(Plane=hframe)  # -> Origin, XAxis, YAxis, ZAxis
c_script = CSharpScript(Vec=deplane.YAxis)  # -> yPositive, yNegative; inputs Vec: Vector3d; same code as c_script
pl = ConstructPlane(Origin=deplane.Origin, XAxis=deplane.XAxis, YAxis=c_script.yNegative)
pl_2 = ConstructPlane(Origin=deplane.Origin, XAxis=deplane.XAxis, YAxis=c_script.yPositive)
multiplication = Multiplication(A=Slider(1, range=0..10), B=num_2)
offset = OffsetCurve(Curve=dispatch.ListA, Distance=num_2, Plane=pl, Corners=1)
offset_2 = OffsetCurve(Curve=dispatch.ListA, Distance=multiplication, Plane=pl_2, Corners=1)

# ----
offset_3 = OffsetCurve(Curve=dispatch.ListB, Distance=expr("-x", num), Corners=1)
offset_4 = OffsetCurve(Curve=dispatch.ListB, Distance=num, Corners=1)
simplify = SimplifyTree(Tree=offset, Front=False)
simplify_2 = SimplifyTree(Tree=offset_2, Front=False)
连接道路宽度 = ClusterInput()
simplify_3 = SimplifyTree(Tree=offset_4, Front=False)
simplify_4 = SimplifyTree(Tree=offset_3, Front=False)
连接道路 = ClusterInput()
division_6 = Division(A=连接道路宽度, B=2)
merge = Merge(Data1=simplify_3, Data2=simplify_4, Data3=simplify, Data4=simplify_2)
combine_2 = CombineData(Input0=division_6, Input1=Slider(1.5, range=0..10))  # -> Result, Index
clean = CleanTree(RemoveNulls=True, RemoveInvalid=True, RemoveEmpty=False, Tree=merge)
offset_5 = OffsetCurve(Curve=连接道路, Distance=expr("-x", combine_2.Result), Corners=1)
offset_6 = OffsetCurve(Curve=连接道路, Distance=combine_2.Result, Corners=1)
Z = UnitZ(Factor=1)
loft = Loft(Curves=clean, Options={Adjust=False, Closed=False, LoftEnds=0, LoftSimp=0, LoftType=0, Rebuild=10, Refit=0.01})
merge_2 = Merge(Data1=offset_6, Data2=offset_5)
panel_3 = Panel(clean)
multiplication_2 = Multiplication(A=Z, B="-2")
loft_2 = Loft(Curves=merge_2, Options={Adjust=False, Closed=False, LoftEnds=0, LoftSimp=0, LoftType=0, Rebuild=10, Refit=0.01})
entwine = Entwine(Branch00=loft_2, Branch01=loft, FlattenInputs=True)
move = Move(Geometry=entwine, Motion=Z)  # -> Geometry, Transform
extr = Extrude(Base=move.Geometry, Direction=multiplication_2)
flatten = FlattenTree(Tree=extr, Path="{0}")
clean_2 = CleanTree(RemoveNulls=True, RemoveInvalid=True, RemoveEmpty=False, Tree=flatten)
edges = BrepEdges(Brep=loft)  # -> Naked, Interior, NonManifold
trim = TrimSolid(Shape=boundary, Cutters=clean_2)
join = JoinCurves(Curves=edges.Naked, Preserve=False)
edges_2 = BrepEdges(Brep=trim)  # -> Naked, Interior, NonManifold
rdiff = RegionDifference(CurvesA=boundary, CurvesB=flatten(join))
join_2 = JoinCurves(Curves=edges_2.Naked, Preserve=False)
flatten_2 = FlattenTree(Tree=rdiff, Path="{0}")
simplify_5 = SimplifyTree(Tree=join_2, Front=False)
地块环线 = ClusterOutput(flatten_2)
T = ClusterOutput(simplify_5)

# ==== cluster Cluster: 指定轴线方向矩形长度
C = ClusterInput()
axis = ClusterInput()
explode = Explode(Curve=C, Recursive=True)  # -> Segments, Vertices
c_script = CSharpScript(axis=axis)  # -> A; inputs axis: String
# ---------- c_script: C# ----------
    if(axis == "x" || axis == "X") A = 0;
    if(axis == "y" || axis == "Y") A = 1;
    if(axis == "z" || axis == "Z") A = 2;
# ---------- end c_script ----------
midpt = CurveMiddle(Curve=explode.Segments)
pdecon = Deconstruct(Point=midpt)  # -> XComponent, YComponent, ZComponent
filter = StreamFilter(Gate=c_script, Stream0=pdecon.XComponent, Stream1=pdecon.YComponent, Stream2=pdecon.ZComponent)
item = ListItem(List=filter, Index=0, Wrap=True)  # -> Item, Item1, Item2, Item3
subtraction = Subtraction(A=item.Item, B=item.Item2)
subtraction_2 = Subtraction(A=item.Item1, B=item.Item3)
abs = Absolute(Value=subtraction)
abs_2 = Absolute(Value=subtraction_2)
c_script_2 = CSharpScript(x=abs, y=abs_2)  # -> A; inputs x: Double, y: Double
# ---------- c_script_2: C# ----------
    if(x > y) A = x;
    else A = y;
# ---------- end c_script_2 ----------
length = ClusterOutput(c_script_2)

# ==== cluster 底面边界: 获取物体上下面边界曲线Polyline； G为0时取底面边界； G为1时取顶面边界；
B = ClusterInput()
debrep = DeconstructBrep(Brep=B)  # -> Faces, Edges, Vertices
pcen = PolygonCenter(Polyline=debrep.Faces)  # -> CenterV, CenterE, CenterA
pdecon = Deconstruct(Point=pcen.CenterV)  # -> XComponent, YComponent, ZComponent
sort = SortList(Keys=pdecon.ZComponent, ValuesA=debrep.Faces)  # -> Keys, ValuesA
item = ListItem(List=reverse(sort.ValuesA), Index=0, Wrap=True)
item_2 = ListItem(List=sort.ValuesA, Index=0, Wrap=True)
G = ClusterInput()
filter = StreamFilter(Gate=G, Stream0=item_2, Stream1=item)
edges = BrepEdges(Brep=filter)  # -> Naked, Interior, NonManifold
join = JoinCurves(Curves=edges.Naked, Preserve=False)
trim = TrimTree(Tree=join, Depth=Slider(3, range=0..10))
T = ClusterOutput(trim)
