# Grasshopper definition PathCreation.gh (Grasshopper 1.0.7)
# plug-ins: Human, PathCreation, EleFront, UiPlus, ProvingGround.Conduit, MetaHopper

crv = Curve(reparameterize(<curve referenced from the Rhino model>))
crv_2 = Curve(reparameterize(crv))
scalebox = ScaleBox(num=Slider(3, range=0..100), R=crv_2)
eval = EvaluateCurve(Curve=crv_2, Parameter=Slider(0.7, range=0..1))  # -> Point, Tangent, Angle
外侧道路宽度 = Slider(7, range=0..10)
主要道路宽度 = Slider(6, range=0..10)
连接道路宽度 = Slider(3, range=0..10)
button = UiButton(Label="清空连线起点终点数据")
get_values = UIValues(Element=button)
panel = Panel(get_values)
c_script = CSharpScript(x=get_values)  # -> out, A; inputs x: Boolean
# ---------- c_script: C# ----------
    if(x == false) A = "选择";
    //if(x == true) A = "选择";
# ---------- end c_script ----------
选点 = UIRhinoSelectButton(Label="选择", Filter=1)
label = UiLabel(Label="提示：分组选择，请按照“起点->终点”的顺序选择，单击按钮可添加下一组")
objbynn = GetObjectByNickname(NickName="选点")
equals = Equality(FirstNumber=get_values, SecondNumber=0)  # -> Equality, Inequality
merge = Merge(Data1=label, Data2=选点, Data3=button)  # -> flatten(Result)
onoff = EnableDisableObject(Objects=objbynn, Enabled=equals.Equality, AllObjects_Object=选点)
get_values_2 = UIValues(Element=选点)
align = UiAlign(Element=merge, Alignment=1)
panel_2 = Panel(get_values_2)
连接道路宽度_2 = Number(连接道路宽度)
连接道路宽度_3 = Number(主要道路宽度)
multiplication = Multiplication(A=连接道路宽度_2, B=2)
multiplication_2 = Multiplication(A=连接道路宽度_3, B=2)
window = UIWindow(Elements=align, Title="选择起始点与终点", Owner=1, Scroll=True, Launch=Button())
slider = UiSlider(Value=连接道路宽度_2, Bounds=multiplication, Increment=0.1)
button_2 = UiButton(Label="复原")
button_3 = UiButton(Label="调整")
slider_2 = UiSlider(Value=连接道路宽度_3, Bounds=multiplication_2, Increment=0.1)
button_4 = UiButton(Label="复原")
button_5 = UiButton(Label="调整")
reflay = ReferenceByLayer(LayerName="场地外围线", DisableAutoUpdate=False)
reflay_2 = ReferenceByLayer(LayerName="楼栋平面", DisableAutoUpdate=False)
reflay_3 = ReferenceByLayer(LayerName="主要道路线", DisableAutoUpdate=False)
button_6 = Button()
data_rec = PythonScript(x=panel_2, enable=Toggle(True), reset=get_values)  # -> x; inputs x: tree, enable: Boolean, reset: Boolean, limit: Int32
# ---------- data_rec: Python ----------
from Grasshopper import DataTree
if reset or 'rec' not in globals(): rec = DataTree[object]()
if enable and not reset: rec.MergeTree(x)
if limit > 0:
  for branch in rec.Branches:
    if branch.Count > limit:
      branch.RemoveRange(0, branch.Count - limit)
x = rec
# ---------- end data_rec ----------
button_7 = Button()
reflay_4 = ReferenceByLayer(LayerName="连接道路线", DisableAutoUpdate=False)
panel_3 = Panel(reflay)
panel_4 = Panel(reflay_2)
panel_5 = Panel(reflay_3)
get_values_3 = UiValues(Element=button_3)
get_values_4 = UiValues(Element=button_5)
equals_2 = Equality(FirstNumber=get_values_3, SecondNumber=Toggle(False))  # -> Equality, Inequality
crv_3 = Curve(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)
楼栋平面_default = Curve([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])
主要道路_default = Curve([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])
pt = Point(data_rec)
flatten = FlattenTree(Tree=pt, Path="{0}")
equals_3 = Equality(FirstNumber=get_values_4, SecondNumber=Toggle(False))  # -> Equality, Inequality
data = Data(reflay_4)
merge_2 = Merge(Data1=slider, Data2=button_3, Data3=button_2)  # -> flatten(Result)
partition = PartitionList(List=flatten, Size=Slider(2, range=0..10))
lng = ListLength(List=flatten(partition))
merge_3 = Merge(Data1=slider_2, Data2=button_5, Data3=button_4)  # -> flatten(Result)
combine = CombineData(Input0=reflay_3, Input1=主要道路_default)  # -> Result, Index
panel_6 = Panel(reflay_4)
panel_7 = Panel(pt)
combine_2 = CombineData(Input0=reflay_4, Input1=crv_3)  # -> Result, Index
lng_2 = ListLength(List=data)
判断数据匹配是否有问题 = CSharpScript(x=lng)  # -> A; inputs x: Int32
# ---------- 判断数据匹配是否有问题: C# ----------
    if(x % 2 == 0)
      A = false;
    else
      A = true;
# ---------- end 判断数据匹配是否有问题 ----------

panel_8 = Panel("""起始点与终点数量无法匹配，
请重新选择""")
警告 = 警告(text=panel_8, height=Slider(20, range=0..100))  # -> drawobjs, G
hud = HeadsUpDisplayHUD(
    ShowHUD=判断数据匹配是否有问题,
    DrawingObjects=警告.drawobjs,
    DrawingBoundary=警告.G,
    ConduitStyleSheet="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")

combine_3 = CombineData(Input0=reflay_2, Input1=楼栋平面_default)  # -> Result, Index
selobj = ObjectsBySelection(Reset=equals_2.Equality, LiveMode=False)
get_values_5 = UiValues(Element=slider)
selobj_2 = ObjectsBySelection(Reset=equals_3.Equality, LiveMode=False)
get_values_6 = UiValues(Element=slider_2)
gate = StreamGate(Stream=partition, Gate=判断数据匹配是否有问题)  # -> Target0, Target1
楼栋平面 = Curve(combine_3.Result)
crv_4 = Curve(combine.Result)
data_2 = Data(crv_4)
lng_3 = ListLength(List=data_2)
window_2 = UiWindow(Elements=merge_2, Title="调整连接道路宽度", Owner=1, Scroll=False, Launch=button_6)
window_3 = UiWindow(Elements=merge_3, Title="调整主要道路宽度", Owner=1, Scroll=False, Launch=button_7)
场地外围线_default = Curve(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)
get_values_7 = UiValues(Element=button_2)
get_values_8 = UiValues(Element=button_4)
dup = DuplicateData(Data=连接道路宽度_2, Number=lng_2, Order=True)
item = ListItem(List=gate.Target0, Index=0, Wrap=True)  # -> Item, Item1
id = Guid(data)
dup_2 = DuplicateData(Data=连接道路宽度_3, Number=lng_3, Order=True)
id_2 = Guid(selobj)
id_3 = Guid(data_2)
id_4 = Guid(selobj_2)
flatten_2 = FlattenTree(Tree=楼栋平面, Path="{0}")
crv_5 = Curve(combine_2.Result)
combine_4 = CombineData(Input0=reflay, Input1=场地外围线_default)  # -> Result, Index
or = GateOr(A=button_6, B=get_values_7)
c_script_2 = CSharpScript(all_GUID=id, Guid=id_2)  # -> out, A; inputs all_GUID: list of Guid, Guid: Guid
# ---------- c_script_2: C# ----------
    for(int i = 0;i < all_GUID.Count;i++)
    {
      if(all_GUID[i]==Guid)
        A = i;
    }
# ---------- end c_script_2 ----------
or_2 = GateOr(A=button_7, B=get_values_8)
c_script_3 = CSharpScript(all_GUID=id_3, Guid=id_4)  # -> out, A; inputs all_GUID: list of Guid, Guid: Guid; same code as c_script_2
pt_2 = Point(item.Item)
crv_6 = Curve(combine_4.Result)
记录对应的调整记录 = CSharpScript(oData=dup, nData=get_values_5, reset=or, index=c_script_2.A)  # -> out, A, B, C; inputs oData: list of Double, nData: list of Double, reset: Boolean, index: list of Int32
# ---------- 记录对应的调整记录: C# ----------
    //oData为原有数据，nData为某一个新数据，index为原有数据中需要更新的索引，reset之前outData可以持续更新
    path++;
    A = DTree;
    B = rIndex;
    outData = new List<double>(oData);

    if(reset)
    {
      path = 0;
      _data.Clear();
      DTree.Clear();
      rIndex.Clear();
      outData.Clear();

      return;
    }

    //_data.Add(nData);
    DTree.AddRange(nData, new GH_Path(path));
    rIndex.AddRange(index, new GH_Path(path));
    for(int i = 1;i < path;i++)
    {
      double replaceData = DTree.Branch(i)[0];
      foreach(int j in rIndex.Branch(i))
      {
        outData[j] = replaceData;
      }
    }

    C = outData;
# ---------- 记录对应的调整记录: C# additional code ----------
  public static List<object> _data = new List<object>();
  public static DataTree<double> DTree = new DataTree<double>();
  public static DataTree<int> rIndex = new DataTree<int>();
  List<double> outData;
  int path = 0;
# ---------- end 记录对应的调整记录 ----------
记录对应的调整记录_2 = CSharpScript(oData=dup_2, nData=get_values_6, reset=or_2, index=c_script_3.A)  # -> out, A, B, C; inputs oData: list of Double, nData: list of Double, reset: Boolean, index: list of Int32; same code as 记录对应的调整记录
panel_9 = Panel(记录对应的调整记录_2.C)
panel_10 = Panel(记录对应的调整记录.C)

# ---- group: 寻找点与楼的关系
flatten_3 = FlattenTree(Tree=item.Item, Path="{0}")
crv_cp = CurveClosestPoint(Point=graft(flatten_3), Curve=flatten_2)  # -> Point, Parameter, Distance
sort = SortList(Keys=crv_cp.Distance, ValuesA=flatten_2)  # -> Keys, ValuesA
item_2 = ListItem(List=sort.ValuesA, Index=0, Wrap=True)
item_3 = ListItem(List=sort.Keys, Index=0, Wrap=True)
flatten_4 = FlattenTree(Tree=item_2, Path="{0}")
smaller = SmallerThan(FirstNumber=item_3, SecondNumber=Slider(0.01, range=0..0.01))  # -> SmallerThan, OrEqualTo
flatten_5 = FlattenTree(Tree=smaller.OrEqualTo, Path="{0}")
dispatch = Dispatch(List=flatten_3, DispatchPattern=flatten_5)  # -> ListA, ListB
dispatch_2 = Dispatch(List=flatten_4, DispatchPattern=flatten_5)  # -> ListA, ListB

# ----
crv_7 = Curve(<curve referenced from the Rhino model>)
组团4 = Curve([<curve referenced from the Rhino model> x2])
组团1 = Curve(<curve referenced from the Rhino model>)
组团2 = Curve(<curve referenced from the Rhino model>)
组团3 = Curve(<curve referenced from the Rhino model>)
场地外围线 = Curve(crv_6)
外侧道路宽度_2 = Number(外侧道路宽度)
c_script_4 = CSharpScript(curve=crv_7)  # -> out, A, B, C; inputs curve: Curve
# ---------- c_script_4: C# usings ----------
using Rhino.Geometry.Intersect;
# ---------- c_script_4: C# ----------
    A = GetOrientPlane(curve);
    Print(GetOrientPlane(curve).ToString());
    B = curve.GetBoundingBox(GetOrientPlane(curve));
    //C = GetOrientPlane(curve);
# ---------- c_script_4: C# additional code ----------
  public Plane GetOrientPlane(Curve curve)
  {
    Point3d centerPt = AreaMassProperties.Compute(curve).Centroid;
    Vector3d x = Vector3d.XAxis;
    Vector3d y = Vector3d.YAxis;

    Line line1 = new Line(centerPt, Vector3d.XAxis, 1);
    CurveIntersections crvInt1 = Intersection.CurveLine(curve, line1, 0.01, 0.01);
    double length = crvInt1[0].PointB.DistanceTo(crvInt1[1].PointB);
    double n = 30;
    List<Line> xline = new List<Line>();

    for(int i = 1; i < n; i++)
    {
      double tempRotate = i * Math.PI / n;
      Vector3d xtemp = Vector3d.XAxis;
      Vector3d ytemp = Vector3d.YAxis;
      xtemp.Rotate(tempRotate, Vector3d.ZAxis);
      ytemp.Rotate(tempRotate, Vector3d.ZAxis);
      xline.Add(new Line(centerPt, xtemp, 1));

      Line line = new Line(centerPt, xtemp, 1);
      CurveIntersections crvInt = Intersection.CurveLine(curve, line, 0.01, 0.01);
      Point3d startPt = crvInt[0].PointB;
      Point3d endPt = crvInt[1].PointB;
      if (startPt.DistanceTo(endPt) <= length)
      {
        length = startPt.DistanceTo(endPt);
        x = xtemp;
        y = ytemp;
      }
    }
    Plane orientPlane = new Plane(centerPt, x, y);
    //return xline;
    return orientPlane;

  }
# ---------- end c_script_4 ----------
bbox = BoundingBox(Content=组团1, Plane=PlaneXY(0, 0, 0), UnionBox=True)  # -> Box, Box_2
bbox_2 = BoundingBox(Content=组团2, Plane=PlaneXY(0, 0, 0), UnionBox=True)  # -> Box, Box_2
bbox_3 = BoundingBox(Content=组团3, Plane=PlaneXY(0, 0, 0), UnionBox=True)  # -> Box, Box_2
bbox_4 = BoundingBox(Content=组团4, Plane=PlaneXY(0, 0, 0), UnionBox=True)  # -> Box, Box_2
crv_8 = Curve(<curve referenced from the Rhino model>)
组团1_2 = Curve([<curve referenced from the Rhino model> x2])
组团2_2 = Curve([<curve referenced from the Rhino model> x2])
组团3_2 = Curve(<curve referenced from the Rhino model>)
组团4_2 = Curve(<curve referenced from the Rhino model>)
panel_11 = Panel(c_script_4.out)
debox = DeconstructBox(Box=c_script_4.B)  # -> Plane, X, Y, Z
bbox_5 = BoundingBox(Content=crv_7, Plane=c_script_4.A)  # -> Box, Box_2
pt_3 = Point(item.Item1)
主要道路 = Curve(crv_4)
主要道路宽度_2 = Number(主要道路宽度)
bbox_6 = BoundingBox(Content=组团1_2, Plane=PlaneXY(0, 0, 0), UnionBox=True)  # -> Box, Box_2
bbox_7 = BoundingBox(Content=组团2_2, Plane=PlaneXY(0, 0, 0), UnionBox=True)  # -> Box, Box_2
bbox_8 = BoundingBox(Content=组团3_2, Plane=PlaneXY(0, 0, 0), UnionBox=True)  # -> Box, Box_2
bbox_9 = BoundingBox(Content=组团4_2, Plane=PlaneXY(0, 0, 0), UnionBox=True)  # -> Box, Box_2
number_slider = Slider(4, range=0..10)
division = Division(A=主要道路宽度_2, B=2)
entwine = Entwine(Branch00=bbox.Box, Branch01=bbox_2.Box, Branch02=bbox_3.Box, Branch03=bbox_4.Box, FlattenInputs=True)
flatten_6 = FlattenTree(Tree=pt_3, Path="{0}")
crv_cp_2 = CurveClosestPoint(Point=graft(flatten_6), Curve=主要道路)  # -> Point, Parameter, Distance
addition = Addition(A=division, B=Slider(2, range=0..10))
scalebox_2 = ScaleBox(num=number_slider, R=crv_8)
sort_2 = SortList(Keys=crv_cp_2.Distance, ValuesA=主要道路)  # -> Keys, ValuesA
rec = Rectangle(entwine)
entwine_2 = Entwine(Branch00=bbox_6.Box, Branch01=bbox_7.Box, Branch02=bbox_8.Box, Branch03=bbox_9.Box, FlattenInputs=True)
item_4 = ListItem(List=sort_2.ValuesA, Index=0, Wrap=True)
scalebox_3 = ScaleBox(num=Slider(5, range=0..100), R=dispatch_2.ListA)
scalebox_4 = ScaleBox(num=number_slider, R=楼栋平面)
offset = OffsetCurve(Curve=item_4, Distance=expr("-x", addition), Corners=1)
offset_2 = OffsetCurve(Curve=item_4, Distance=addition, Corners=1)
rec_2 = Rectangle(entwine_2)
crv_cp_3 = CurveClosestPoint(Point=dispatch.ListA, Curve=scalebox_3)  # -> Point, Parameter, Distance
merge_4 = Merge(Data1=offset_2, Data2=offset)
crv_9 = Curve(scalebox_4)
graft = GraftTree(Tree=flatten_6, IncludeEmptyLists=True, IncludeNullItems=True)
graft_2 = GraftTree(Tree=crv_cp_3.Point, IncludeEmptyLists=True, IncludeNullItems=True)
crv_cp_4 = CurveClosestPoint(Point=graft_2, Curve=merge_4)  # -> Point, Parameter, Distance
sort_3 = SortList(Keys=crv_cp_4.Distance, ValuesA=merge_4)  # -> Keys, ValuesA
item_5 = ListItem(List=sort_3.ValuesA, Index=0, Wrap=True)

# ---- group: 端点显示
cir = Circle(Plane=dispatch.ListA, Radius=Slider(5, range=0..10))
dash = DashPattern(Curve=cir, Pattern="1")  # -> Dashes, Gaps
previewlw = CustomPreviewLineweights(Geometry=dash.Dashes, Shader=ColourSwatch(SwatchColor=RGB(255, 55, 0)), Thickness=Slider(2, range=0..10), Absolute=False)

# ----
crv_cp_5 = CurveClosestPoint(Point=graft, Curve=item_5)  # -> Point, Parameter, Distance
pc = PathCreation(StartPoint=graft_2, EndPoint=crv_cp_5.Point, Obstacle=crv_9, Resolution=Slider(5, range=0..100), Orthogonal=Toggle(True))  # -> OutputPath, PathGrid
disc = Discontinuity(Curve=rec_2, Level=1)  # -> Points, Parameters
explode = Explode(Curve=pc.OutputPath, Recursive=True)  # -> Segments, Vertices
join = JoinCurves(Curves=explode.Segments, Preserve=False)
number_slider_2 = Slider(1, range=0..1)
disc_2 = Discontinuity(Curve=join, Level=1)  # -> Points, Parameters
场地外围线_2 = Curve(crv_6)
flatten_7 = FlattenTree(Tree=dispatch.ListA, Path="{0}")
rev = ReverseList(List=disc_2.Points)
graft_3 = GraftTree(Tree=flatten_7, IncludeEmptyLists=True, IncludeNullItems=True)
ins = InsertItems(List=rev, Item=graft_3, Indices=Slider(0, range=0..100), Wrap=True)
ins_2 = InsertItems(List=ins, Item=graft, Indices="-1", Wrap=True)
外侧景观宽度 = Slider(5, range=0..10)
外侧景观宽度_2 = Number(外侧景观宽度)
addition_2 = Addition(A=外侧景观宽度_2, B=外侧道路宽度_2)
offset_3 = OffsetCurve(Curve=场地外围线, Distance=expr("-x", addition_2), Corners=1)
offset_4 = OffsetCurve(Curve=场地外围线, Distance=expr("-x", 外侧景观宽度_2), Corners=1)

# ---- group: 组团分割路
宽度 = Slider(5, range=0..10)
padding = Slider(5, range=0..10)
division_2 = Division(A=宽度, B=2)
addition_3 = Addition(A=padding, B=division_2)
offset_5 = OffsetCurve(Curve=rec_2, Distance=addition_3, Corners=1)
division_3 = Division(A=padding, B=2)
fillet = Fillet(Curve=offset_5, Radius=Slider(4, range=0..10))
offset_6 = OffsetCurve(Curve=fillet, Distance=expr("-x", division_3), Corners=1)
crv_10 = Curve(<curve referenced from the Rhino model>)
offset_7 = OffsetCurve(Curve=fillet, Distance=division_3, Corners=1)
offset_8 = OffsetCurve(Curve=crv_10, Distance=Slider(100, range=0..100), Corners=1)
merge_5 = Merge(Data1=offset_7, Data2=offset_6)
boundary = BoundarySurfaces(Edges=flatten([crv_10, offset_8]))
Z = UnitZ(Factor=1)
loft = Loft(Curves=merge_5, Options={Adjust=False, Closed=False, LoftEnds=0, LoftSimp=0, LoftType=0, Rebuild=10, Refit=0.01})
move = Move(Geometry=boundary, Motion=Z)  # -> Geometry, Transform
multiplication_3 = Multiplication(A=Z, B=-2)
boundary_2 = BoundarySurfaces(Edges=flatten([offset_3, offset_4]))
extr = Extrude(Base=move.Geometry, Direction=multiplication_3)
trim = TrimSolid(Shape=loft, Cutters=extr)
sunion = SolidUnion(Breps=flatten([trim, boundary_2]))
edges = BrepEdges(Brep=sunion)  # -> Naked, Interior, NonManifold
area = Area(Geometry=rec_2)  # -> Area, Centroid
crv_11 = Curve(edges.Naked)
sort_4 = SortList(Keys=flatten(area.Area))  # -> Keys, ValuesA
join_2 = JoinCurves(Curves=crv_11, Preserve=False)
fillet_2 = Fillet(Curve=join_2, Radius=Slider(2, range=0..10))
item_6 = ListItem(List=sort_4.Keys, Index=0, Wrap=True)
area_2 = Area(Geometry=fillet_2)  # -> Area, Centroid
smaller_2 = SmallerThan(FirstNumber=area_2.Area, SecondNumber=item_6)  # -> SmallerThan, OrEqualTo
dispatch_3 = Dispatch(List=fillet_2, DispatchPattern=smaller_2.OrEqualTo)  # -> ListA, ListB
crv_12 = Curve(dispatch_3.ListB)
boundary_3 = BoundarySurfaces(Edges=flatten(crv_12))

# ----
bbox_10 = BoundingBox(Content=offset_4, Plane=PlaneXY(0, 0, 0), UnionBox=True)  # -> Box, Box_2
c_script_5 = CSharpScript(Box=bbox_10.Box)  # -> A; inputs Box: Box
# ---------- c_script_5: C# ----------
    A = Box.Center;
# ---------- end c_script_5 ----------
dist = Distance(PointA=c_script_5, PointB=disc.Points)
sort_5 = SortList(Keys=dist, ValuesA=disc.Points)  # -> Keys, ValuesA
item_7 = ListItem(List=sort_5.ValuesA, Index=0, Wrap=True)
scale = Scale(Geometry=rec_2, Center=item_7, Factor=Slider(3, range=0..10))  # -> Geometry, Transform
offset_9 = OffsetCurve(Curve=scale.Geometry, Distance=Slider(4, range=0..10), Corners=1)
flatten_8 = FlattenTree(Tree=offset_9, Path="{0}")
rdiff = RegionDifference(CurvesA=offset_4, CurvesB=flatten_8)
explode_2 = Explode(Curve=rdiff, Recursive=True)  # -> Segments, Vertices
树木基础半径 = Slider(2, range=0..10)
疏密度_0_1 = Slider(0.7, range=0..1)
pline = PolyLine(Vertices=ins_2, Closed=False)
crv_13 = Curve([pline, crv_5])

toggle = BooleanToggle(False)
createatts = CreateAttributes(LayerName="连接道路线", enableFullPath=False)
equals_4 = Equality(FirstNumber=toggle, SecondNumber=0)  # -> Equality, Inequality
bake = BakeGeometry(Bake=toggle, Geometry=pline, Attributes=createatts, DeleteOldBakes=False, PreserveTrees=False)
objbynn_2 = GetObjectByNickname(NickName="创建道路_Bake前")
objbynn_3 = GetObjectByNickname(NickName="创建道路_Bake后")
onoff_2 = EnableDisableObject(Objects=objbynn_2, Enabled=equals_4.Equality, AllObjects_Object=创建道路_bake前)
onoff_3 = EnableDisableObject(Objects=objbynn_3, Enabled=toggle, AllObjects_Object=创建道路_bake后)

随机程度 = Slider(0.6, range=0..1)
seed = Slider(3, range=0..10)
midpt = CurveMiddle(Curve=explode_2.Segments)
crv_cp_6 = CurveClosestPoint(Point=midpt, Curve=offset_4)  # -> Point, Parameter, Distance
smaller_3 = SmallerThan(FirstNumber=crv_cp_6.Distance, SecondNumber=Slider(0.01, range=0..0.01))  # -> SmallerThan, OrEqualTo
dispatch_4 = Dispatch(List=explode_2.Segments, DispatchPattern=smaller_3.SmallerThan)  # -> ListA, ListB
创建道路_bake后 = 创建道路_Bake前(
    连接道路=reflay_4,
    外侧景观宽度=外侧景观宽度,
    场地外围线=场地外围线_2,
    外侧道路宽度=外侧道路宽度,
    unit=number_slider_2,
    轴线指定宽度=记录对应的调整记录_2.C,
    主要道路=crv_4,
    连接道路宽度=记录对应的调整记录.C,
    楼栋平面=flatten_2)  # -> plotboundary, outpath, outempty; disabled
创建道路_bake前 = 创建道路_Bake前(
    连接道路=crv_13,
    外侧景观宽度=外侧景观宽度,
    场地外围线=场地外围线_2,
    外侧道路宽度=外侧道路宽度,
    unit=number_slider_2,
    轴线指定宽度=记录对应的调整记录_2.C,
    主要道路=crv_4,
    连接道路宽度=连接道路宽度,
    楼栋平面=flatten_2)  # -> plotboundary, outpath, outempty
crv_14 = Curve(dispatch_4.ListA)
join_3 = JoinCurves(Curves=crv_14, Preserve=False)
crv_15 = Curve(join_3)
道路宽度 = Slider(6, range=0..10)
avr = Average(Input=flatten(item_7))
midpt_2 = CurveMiddle(Curve=crv_15)
ln = Line(StartPoint=midpt_2, EndPoint=avr)
combine_5 = CombineData(Input0=创建道路_bake前.plotboundary, Input1=创建道路_bake后.plotboundary)  # -> Result, Index
combine_6 = CombineData(Input0=创建道路_bake前.outpath, Input1=创建道路_bake后.outpath)  # -> Result, Index
combine_7 = CombineData(Input0=创建道路_bake前.outempty, Input1=创建道路_bake后.outempty)  # -> Result, Index
与外围线连接的单一道路 = 与外围线连接的单一道路(T=ln, num=道路宽度, 外侧景观宽度=外侧景观宽度_2, 场地外围线=场地外围线, 外侧道路宽度=外侧道路宽度_2, 倒角半径=Slider(5, range=0..10))
树木基础半径_2 = Slider(2, range=0..10)
疏密度_0_1_2 = Slider(0.5, range=0..1)
随机程度_2 = Slider(0.2, range=0..1)
seed_2 = Slider(5, range=0..10)

num = Number(外侧景观宽度)
num_2 = Number(树木基础半径)
multiplication_4 = Multiplication(A=num_2, B=2)
multiplication_5 = Multiplication(A=num, B=2)
dom = ConstructDomain(DomainStart="1", DomainEnd=multiplication_5)
dom_2 = ConstructDomain(DomainStart="1", DomainEnd=multiplication_4)
merge_6 = Merge(Data1="外侧景观宽度", Data2="树木基础半径", Data3="种植密度", Data4="大小变化", Data5="随机变化")
merge_7 = Merge(Data1=num, Data2=num_2, Data3=疏密度_0_1, Data4=随机程度, Data5=seed)
merge_8 = Merge(Data1=dom, Data2=dom_2, Data3=Slider(1, range=0..1), Data4=Slider(2, range=0..10), Data5=Slider(10, range=0..10))
slider_3 = UiSlider(Label=merge_6, Value=merge_7, Bounds=merge_8, Increment=0.1)
get_values_9 = UiValues(Element=slider_3)
flatten_9 = FlattenTree(Tree=get_values_9, Path="{0}")
panel_12 = Panel(get_values_9)
item_8 = ListItem(List=flatten_9, Index=0, Wrap=True)  # -> Item, Item1, Item2, Item3, Item4

explode_3 = Explode(Curve=combine_5.Result, Recursive=True)  # -> Segments, Vertices

num_3 = Number(树木基础半径_2)
multiplication_6 = Multiplication(A=num_3, B=2)
dom_3 = ConstructDomain(DomainStart="1", DomainEnd=multiplication_6)
merge_9 = Merge(Data1=dom_3, Data2=Slider(1, range=0..1), Data3=Slider(2, range=0..10), Data4=Slider(10, range=0..10))
merge_10 = Merge(Data1="树木基础半径", Data2="种植密度", Data3="大小变化", Data4="随机变化")
merge_11 = Merge(Data1=num_3, Data2=疏密度_0_1_2, Data3=随机程度_2, Data4=seed_2)
slider_4 = UiSlider(Label=merge_10, Value=merge_11, Bounds=merge_9, Increment=0.1)
get_values_10 = UiValues(Element=slider_4)
flatten_10 = FlattenTree(Tree=get_values_10, Path="{0}")
item_9 = ListItem(List=flatten_10, Index=0, Wrap=True)  # -> Item, Item1, Item2, Item3

flatten_11 = FlattenTree(Tree=explode_3.Segments, Path="{0}")
graft_4 = GraftTree(Tree=flatten_11, IncludeEmptyLists=True, IncludeNullItems=True)
end = EndPoints(Curve=graft_4)  # -> Start, End
ln_2 = Line(StartPoint=end.Start, EndPoint=end.End)
midpt_3 = CurveMiddle(Curve=ln_2)
midpt_4 = CurveMiddle(Curve=graft_4)
dist_2 = Distance(PointA=midpt_4, PointB=midpt_3)
smaller_4 = SmallerThan(FirstNumber=dist_2, SecondNumber=0.01)  # -> SmallerThan, OrEqualTo
dispatch_5 = Dispatch(List=graft_4, DispatchPattern=smaller_4.OrEqualTo)  # -> ListA, ListB
darc = DeconstructArc(Arc=dispatch_5.ListB)  # -> BasePlane, Radius, Angle
midpt_5 = CurveMiddle(Curve=dispatch_5.ListB)
radialdim = DefineRadialDimension(Center=darc.BasePlane, Tip=midpt_5, DimensionPlane=PlaneXY(0, 0, 0), DimensionStyle="Default")
slider_5 = UiSlider(Label="种植数量", Value=Slider(3, range=0..10), Bounds=Slider(10, range=0..10), Increment=0.1)
data_3 = Data(radialdim)
get_values_11 = UiValues(Element=slider_5)
panel_13 = Panel("""场地边缘种植
场地道路种植
空地景观种植""")
stack = UiStackLayout(Elements=slider_3, Horizontal=invert(True))
stack_2 = UiStackLayout(Elements=slider_4, Horizontal=invert(True))
楼栋平面_2 = Curve(flatten_2)
boundary_4 = BoundarySurfaces(Edges=楼栋平面_2)
merge_12 = Merge(Data1=stack, Data2=stack_2, Data3=slider_5)  # -> flatten(Result)
data_4 = Data(楼栋平面_2)
tab = UiTabbedLayout(Elements=merge_12, Names=panel_13)
graft_5 = GraftTree(Tree=data_4, IncludeEmptyLists=True, IncludeNullItems=True)
环绕种植 = 环绕种植(随机程度=item_9.Item2, seed=item_9.Item3, C=combine_5.Result, 树木基础半径=item_9.Item, 疏密度_0_1=item_9.Item1)
number_slider_3 = Slider(10, range=0..10)
场地周边种植 = 场地周边种植(随机程度=item_8.Item3, seed=item_8.Item4, C=场地外围线_2, D=item_8.Item, 树木基础半径=item_8.Item1, 疏密度_0_1=item_8.Item2)
explode_4 = Explode(Curve=graft_5, Recursive=True)  # -> Segments, Vertices
len = Length(Curve=explode_4.Segments)
window_4 = UiWindow(Elements=tab, Title="景观控制面板", Owner=1, Scroll=False, Launch=Button())
sort_6 = SortList(Keys=len, ValuesA=explode_4.Segments)  # -> Keys, ValuesA
rev_2 = ReverseList(List=sort_6.ValuesA)
xy = XYPlane(Origin=Point(0, 0, 0))
item_10 = ListItem(List=rev_2, Index=0, Wrap=True)
end_2 = EndPoints(Curve=item_10)  # -> Start, End
vec2pt = Vector2Pt(PointA=end_2.Start, PointB=end_2.End, Unitize=False)  # -> Vector, Length
align_2 = AlignPlane(Plane=xy, Direction=vec2pt.Vector)  # -> Plane, Angle
bbox_11 = BoundingBox(Content=graft_5, Plane=align_2.Plane)  # -> Box, Box_2
rec_3 = Rectangle(bbox_11.Box)
explode_5 = Explode(Curve=rec_3, Recursive=True)  # -> Segments, Vertices
len_2 = Length(Curve=explode_5.Segments)
sort_7 = SortList(Keys=len_2, ValuesA=explode_5.Segments)  # -> Keys, ValuesA
item_11 = ListItem(List=sort_7.ValuesA, Index=0, Wrap=True)  # -> Item, Item1
item_12 = ListItem(List=sort_7.Keys, Index=0, Wrap=True)
midpt_6 = CurveMiddle(Curve=item_11.Item)
midpt_7 = CurveMiddle(Curve=item_11.Item1)
shift = ShiftList(List=explode_5.Vertices, Shift=1, Wrap=invert(True))  # -> simplify(List)
expression = Expression(x=item_12, y=Slider(5, range=0..10), Expression="x/2+y")
rev_3 = ReverseList(List=sort_7.Keys)
item_13 = ListItem(List=rev_3, Index=0, Wrap=True)
pl_origin = PlaneOrigin(Base=align_2.Plane, Origin=midpt_6)
pl_origin_2 = PlaneOrigin(Base=align_2.Plane, Origin=midpt_7)
division_4 = Division(A=item_13, B=Slider(7, range=0..10))
dom_4 = ConstructDomain(DomainStart=expr("-x", expression), DomainEnd=expression)
number_slider_4 = Slider(2, range=0..10)
dom_5 = ConstructDomain(DomainStart=expr("-x", division_4), DomainEnd=division_4)
rectangle = Rectangle(Plane=pl_origin, XSize=dom_5, YSize=dom_4, Radius=0)  # -> Rectangle, Length
rectangle_2 = Rectangle(Plane=pl_origin_2, XSize=dom_5, YSize=dom_4, Radius=0)  # -> Rectangle, Length
fillet_3 = Fillet(Curve=rectangle.Rectangle, Radius=number_slider_4)
fillet_4 = Fillet(Curve=rectangle_2.Rectangle, Radius=number_slider_4)
entwine_3 = Entwine(Branch00=fillet_3, Branch01=fillet_4, FlattenInputs=True)  # -> flatten(Result)
crv_16 = Curve(combine_5.Result)
rint = RegionIntersection(CurvesA=crv_16, CurvesB=graft(entwine_3))  # -> flatten(Result)
rdiff_2 = RegionDifference(CurvesA=rint, CurvesB=data_4)
custom_mesh_settings = SettingsCustom(
    StitchSeams=True,
    SimplePlanes=False,
    Refine=True,
    MinCount=16,
    MaxCount=400,
    AspectRatio=20,
    MaxDistance=0,
    MaxAngle=20,
    MinEdge=0,
    MaxEdge=0)
boundary_5 = BoundarySurfaces(Edges=rdiff_2)
Z_2 = UnitZ(Factor=1)
mesh = MeshBrep(Brep=boundary_5, Settings=custom_mesh_settings)
tri = Triangulate(Mesh=mesh)  # -> Mesh, Count
multiplication_7 = Multiplication(A=Z_2, B=-2)
move_2 = Move(Geometry=boundary_5, Motion=Z_2)  # -> Geometry, Transform
extr_2 = Extrude(Base=move_2.Geometry, Direction=multiplication_7)
faceb = FaceBoundaries(Mesh=tri.Mesh)
explode_6 = Explode(Curve=faceb, Recursive=True)  # -> Segments, Vertices
trim_2 = TrimSolid(Shape=combine_7.Result, Cutters=extr_2)
空地种植 = 空地种植(V=get_values_11, T=trim_2)
circlemesh = CSharpScript(Circle=[环绕种植, 场地周边种植, 空地种植], Num=number_slider_3)  # -> A; inputs Num: Int32
# ---------- circlemesh: C# ----------
    //double[] tL = Circle.DivideByCount(Num, true);
    Point3d[] pL;
    int n;
    if(Num == 0)
      n = 6;
    else
      n = Num;
    NurbsCurve crv = Circle.ToNurbsCurve();
    crv.DivideByCount(n, true, out pL);

    Mesh mesh = new Rhino.Geometry.Mesh();
    mesh.Vertices.Add(Circle.Center);
    foreach(Point3d p in pL)
    {
      mesh.Vertices.Add(p);
    }
    for(int i = 1;i < pL.Length;i++)
    {
      mesh.Faces.AddFace(0, i, i + 1);
    }
    mesh.Faces.AddFace(0, pL.Length, 1);


    A = mesh;
# ---------- end circlemesh ----------

# ---- group: Obsolete
number_slider_5 = Slider(2, range=0..10)  # disabled
toggle_2 = BooleanToggle(True)  # disabled
button_8 = Button()  # disabled
pt_4 = ConstructPoint(XCoordinate=0, YCoordinate=0, ZCoordinate=0)  # disabled
toggle_3 = BooleanToggle(True)  # disabled
button_9 = Button()  # disabled
道路生成 = 道路生成(楼栋平面=[<geometry referenced from the Rhino model> x2])  # -> R, S, C, outpath
data_rec_2 = PythonScript(enable=toggle_2, reset=button_8)  # -> x; inputs data: list, x: tree, enable: Boolean, reset: Boolean, limit: Int32; disabled
# ---------- data_rec_2: Python ----------
from Grasshopper import DataTree
if reset or 'rec' not in globals(): rec = DataTree[object]()
if enable and not reset: rec.MergeTree(x)
if limit > 0:
  for branch in rec.Branches:
    if branch.Count > limit:
      branch.RemoveRange(0, branch.Count - limit)

for i in x.AllData():
    data[i]=replace
x = data
# ---------- end data_rec_2 ----------
data_rec_3 = PythonScript(x=number_slider_5, enable=toggle_3, reset=button_9)  # -> x; inputs x: tree, enable: Boolean, reset: Boolean, limit: Int32; disabled
# ---------- data_rec_3: Python ----------
from Grasshopper import DataTree
if reset or 'rec' not in globals(): 
    rec = DataTree[object]()
if enable and not reset: 
    rec.MergeTree(x)
if limit > 0:
  for branch in rec.Branches:
    if branch.Count > limit:
      branch.RemoveRange(0, branch.Count - limit)
x = rec
# ---------- end data_rec_3 ----------
panel_14 = Panel(data_rec_2)  # disabled

# ----
len_3 = Length(Curve=explode_6.Segments)
sort_8 = SortList(Keys=len_3)  # -> Keys, ValuesA
item_14 = ListItem(List=sort_8.Keys, Index=0, Wrap=True)
larger = LargerThan(FirstNumber=item_14, SecondNumber=Slider(1.88, range=0..10))  # -> LargerThan, OrEqualTo
trim_3 = TrimTree(Tree=larger.OrEqualTo, Depth=1)
dispatch_6 = Dispatch(List=faceb, DispatchPattern=trim_3)  # -> ListA, ListB
disc_3 = Discontinuity(Curve=dispatch_6.ListA, Level=1)  # -> Points, Parameters
item_15 = ListItem(List=disc_3.Points, Index=0, Wrap=True)  # -> Item, Item1, Item2
incircle = InCircle(CornerA=item_15.Item, CornerB=item_15.Item1, CornerC=item_15.Item2)  # -> Circle, Plane, Radius
trim_4 = TrimTree(Tree=incircle.Circle, Depth=1)
tstat = TreeStatistics(Tree=trim_4)  # -> Paths, Length, Count
lng_4 = ListLength(List=tstat.Paths)
series = Series(Start=0, Step=1, Count=lng_4)
lng_5 = ListLength(List=trim_4)
graft_6 = GraftTree(Tree=series, IncludeEmptyLists=True, IncludeNullItems=True)
multiplication_8 = Multiplication(A=lng_5, B=0.5)
reduce = RandomReduce(List=trim_4, Reduction=multiplication_8, Seed=graft_6)
swatch = ColourSwatch(SwatchColor=RGB(0, 191, 48))
circlemesh_2 = CSharpScript(Circle=reduce, Num=number_slider_3)  # -> A; inputs Num: Int32; same code as circlemesh
道路 = Surface(combine_6.Result)

# ---- group: Show
preview = CustomPreview(Geometry=道路, Material=ColourSwatch(SwatchColor=RGB(105, 105, 105)))
preview_2 = CustomPreview(Geometry=circlemesh, Material=swatch)
preview_3 = CustomPreview(Geometry=boundary_4, Material=ColourSwatch(SwatchColor=RGB(255, 255, 255)))
preview_4 = CustomPreview(Geometry=trim_2, Material=ColourSwatch(SwatchColor=RGB(128, 255, 130)))
preview_5 = CustomPreview(Geometry=boundary_5, Material=ColourSwatch(SwatchColor=RGB(150, 255, 102)))
preview_6 = CustomPreview(Geometry=circlemesh_2, Material=swatch)

# ----
groups = GetGroups()  # -> Groups, GroupStyles, Nickname, Color
tmatch = MatchText(Text=groups.Nickname, Pattern="Show", Case=True)
dispatch_7 = Dispatch(List=groups.Groups, DispatchPattern=tmatch)  # -> ListA, ListB
objfromgroup = GetObjectsInGroup(Group=dispatch_7.ListA)
hideshow = HideShowObjectPreview(Objects=objfromgroup, Visible=Toggle(True))

# ==== cluster ScaleBox
num = ClusterInput()
R = ClusterInput()
num_2 = Number(num)
drec = DeconstuctRectangle(Rectangle=R)  # -> BasePlane, XInterval, YInterval
dedomain = DeconstructDomain(Domain=drec.XInterval)  # -> Start, End
dedomain_2 = DeconstructDomain(Domain=drec.YInterval)  # -> Start, End
subtraction = Subtraction(A=dedomain.Start, B=num_2)
addition = Addition(A=dedomain.End, B=num_2)
subtraction_2 = Subtraction(A=dedomain_2.Start, B=num_2)
addition_2 = Addition(A=dedomain_2.End, B=num_2)
dom = ConstructDomain(DomainStart=subtraction, DomainEnd=addition)
dom_2 = ConstructDomain(DomainStart=subtraction_2, DomainEnd=addition_2)
rectangle = Rectangle(Plane=drec.BasePlane, XSize=dom, YSize=dom_2, Radius=0)  # -> Rectangle, Length
R_2 = ClusterOutput(rectangle.Rectangle)

# ==== cluster 道路生成
unit = ClusterInput()
楼栋平面 = ClusterInput()
外侧道路宽度 = ClusterInput()
unit_2 = Number(unit)
combine = CombineData(Input0=外侧道路宽度, Input1=Slider(7, range=0..10))  # -> Result, Index
连接道路 = ClusterInput()
crv = ClusterInput()
外侧景观宽度 = ClusterInput()
multiplication = Multiplication(外围道路宽度=combine.Result, B=unit_2)
multiplication_2 = Multiplication(道路倒角半径=Slider(6, range=0..10), B=unit_2)
number_slider = Slider(0.4, range=0..1)
crv_2 = Curve(crv)
combine_2 = CombineData(Input0=外侧景观宽度, Input1=Slider(6, range=0..10))  # -> Result, Index
crv_3 = Curve(连接道路)
轴线指定宽度 = ClusterInput()
连接道路宽度 = ClusterInput()
指定轴线 = ClusterInput()
fillet = Fillet(Curve=crv_3, Radius=Slider(3, range=0..10))
连接道路_2 = Curve(fillet)
楼栋平面_2 = Curve(楼栋平面)

# ---- group: 在与楼栋平面相交处延长连接线，保证道路完整性
flatten = FlattenTree(Tree=连接道路_2, Path="{0}")
divide = DivideCurve(Curve=flatten, Count=Slider(1, range=0..1), Kinks=False)  # -> Points, Tangents, Parameters
graft = GraftTree(Tree=divide.Points, IncludeEmptyLists=True, IncludeNullItems=True)
crv_cp = CurveClosestPoint(Point=graft, Curve=楼栋平面_2)  # -> Point, Parameter, Distance
sort = SortList(Keys=crv_cp.Distance)  # -> Keys, ValuesA
item = ListItem(List=sort.Keys, Index=0, Wrap=True)
trim = TrimTree(Tree=item, Depth=1)
item_2 = ListItem(List=trim, Index=0, Wrap=True)
smaller = SmallerThan(FirstNumber=item_2, SecondNumber=Slider(0.1, range=0..0.1))  # -> SmallerThan, OrEqualTo
equals = Equality(FirstNumber=item_2, SecondNumber=0)  # -> Equality, Inequality
dispatch = Dispatch(List=flatten, DispatchPattern=flatten(smaller.SmallerThan))  # -> ListA, ListB
flip = FlipCurve(Curve=dispatch.ListB)  # -> Curve, Flag
entwine = Entwine(Branch00=dispatch.ListA, Branch01=flip.Curve, FlattenInputs=True)
flatten_2 = FlattenTree(Tree=entwine, Path="{0}")
ext = ExtendCurve(Curve=flatten_2, Type=0, Start=Slider(5, range=0..10), End=Slider(0, range=0..100))

# ----
offset = OffsetCurve(Curve=crv_2, Distance=expr("-x", combine_2.Result), Corners=1)
offset_2 = OffsetCurve(Curve=offset, Distance=expr("-x", multiplication), Corners=1)
轴线分割 = 轴线分割(_0=轴线指定宽度, 连接道路宽度=连接道路宽度, 轴线控制比例=number_slider, E=offset_2, crv=指定轴线)
ext_2 = ExtendCurve(Curve=fillet, Type=0, Start=Slider(0.5, range=0..1), End=Slider(0, range=0..100))
division = Division(A=连接道路宽度, B=2)
crv_4 = Curve(楼栋平面)
splitatcorners = SplitAtCorners(Poly=轴线分割, Angle=Slider(0.4, range=0..1))  # -> Corners, Parts
graft_2 = GraftTree(Tree=crv_4, IncludeEmptyLists=True, IncludeNullItems=True)
ccx = CurveCurve(CurveA=连接道路, CurveB=graft_2)  # -> Points, ParamsA, ParamsB
lng = ListLength(List=ccx.ParamsB)
pline = PolyLine(Vertices=splitatcorners.Corners, Closed=invert(False))
fillet_2 = Fillet(Curve=pline, Radius=multiplication_2)
fillet_3 = Fillet(Curve=offset_2, Radius=Slider(6, range=0..10))
轴线分割_2 = 轴线分割(连接道路=ext, _0=轴线指定宽度, 连接道路宽度=连接道路宽度, 轴线控制比例=number_slider, E=fillet_3, crv=指定轴线)

# ---- group: 楼栋平面修剪道路区域，并保证修剪后道路是闭合曲线
trim_2 = TrimWithRegions(Curve=轴线分割_2, Regions=楼栋平面_2)  # -> Inside, Outside
crv_5 = Curve(trim_2.Outside)
cls = Closed(Curve=crv_5)  # -> Closed, Periodic
dispatch_2 = Dispatch(List=crv_5, DispatchPattern=cls.Closed)  # -> ListA, ListB
end = EndPoints(Curve=dispatch_2.ListB)  # -> Start, End
ln = Line(StartPoint=end.Start, EndPoint=end.End)
merge = Merge(Data1=ln, Data2=dispatch_2.ListB)
join = JoinCurves(Curves=merge, Preserve=False)
merge_2 = Merge(Data1=simplify(join), Data2=simplify(dispatch_2.ListA))

# ---- group: 与楼栋交接处不倒角，其余地方正常倒角
crv_6 = Curve(reparameterize(merge_2))
disc = Discontinuity(Curve=crv_6, Level=1)  # -> Points, Parameters
flatten_3 = FlattenTree(Tree=disc.Points, Path="{0}")
crv_cp_2 = CurveClosestPoint(Point=graft(flatten_3), Curve=flatten(楼栋平面_2))  # -> Point, Parameter, Distance
sort_2 = SortList(Keys=crv_cp_2.Distance)  # -> Keys, ValuesA
item_3 = ListItem(List=sort_2.Keys, Index=0, Wrap=True)
smaller_2 = SmallerThan(FirstNumber=item_3, SecondNumber=Slider(0.1, range=0..0.1))  # -> SmallerThan, OrEqualTo
flatten_4 = FlattenTree(Tree=smaller_2.SmallerThan, Path="{0}")
unflatten = UnflattenTree(Tree=flatten_4, Guide=disc.Parameters)
dispatch_3 = Dispatch(List=disc.Parameters, DispatchPattern=unflatten)  # -> ListA, ListB
fillet_4 = Fillet(Curve=crv_6, Parameter=dispatch_3.ListB, Radius=Slider(3, range=0..10))  # -> Curve, Parameter
crv_7 = Curve(fillet_4.Curve)
multiplecrv_booleanintersection = CSharpScript(crv=crv_7)  # -> out, A; inputs crv: list of Curve
# ---------- multiplecrv_booleanintersection: C# ----------
    //Curve[] curves = new Curve[crv.Count];
    Curve finalCrv = crv[0];
    for(int i = 1;i < crv.Count;i++)
    {
      //curves[i] = crv[i];
      Curve[] curves = Curve.CreateBooleanIntersection(finalCrv, crv[i],0.001);
      if(curves.Length < 2)
      {
        finalCrv = curves[0];
      }
    }
    A = finalCrv;
# ---------- end multiplecrv_booleanintersection ----------
crv_8 = Curve(offset)
boundary = BoundarySurfaces(Edges=flatten([crv_8, multiplecrv_booleanintersection.A]))

# ----
equals_2 = Equality(FirstNumber=lng, SecondNumber=0)  # -> Equality, Inequality
dispatch_4 = Dispatch(List=graft_2, DispatchPattern=equals_2.Inequality)  # -> ListA, ListB
offset_3 = OffsetCurve(Curve=ext_2, Distance=expr("-x", division), Corners=1)
offset_4 = OffsetCurve(Curve=ext_2, Distance=division, Corners=1)
Z = UnitZ(Factor=1)
Z_2 = UnitZ(Factor=1)
boundary_2 = BoundarySurfaces(Edges=fillet_2)
flatten_5 = FlattenTree(Tree=dispatch_4.ListA, Path="{0}")
boundary_3 = BoundarySurfaces(Edges=flatten_5)
panel = Panel(merge_2)
multiplication_3 = Multiplication(A=Z_2, B=-2)
loft = Loft(
    Curves=[offset_4, offset_3],
    Options={Adjust=False, Closed=False, LoftEnds=0, LoftSimp=0, LoftType=0, Rebuild=10, Refit=0.01})
multiplication_4 = Multiplication(A=Z, B=-2)
entwine_2 = Entwine(Branch00=loft, Branch01=boundary_3, FlattenInputs=True)  # -> flatten(Result)
move = Move(Geometry=boundary_3, Motion=Z)  # -> Geometry, Transform
move_2 = Move(Geometry=entwine_2, Motion=Z)  # -> Geometry, Transform
extr = Extrude(Base=move.Geometry, Direction=multiplication_4)
extr_2 = Extrude(Base=move_2.Geometry, Direction=multiplication_4)
C = ClusterOutput(fillet_2)
boundary_4 = BoundarySurfaces(Edges=crv_2)
flatten_6 = FlattenTree(Tree=boundary_2, Path="{0}")
trim_3 = TrimSolid(Shape=flatten_6, Cutters=flatten(extr_2))
edges = BrepEdges(Brep=trim_3)  # -> Naked, Interior, NonManifold
join_2 = JoinCurves(Curves=edges.Naked, Preserve=False)
divlength = DivideLength(Curve=join_2, Length=Slider(1.8, range=0..10))  # -> Points, Tangents, Parameters
pline_2 = PolyLine(Vertices=divlength.Points, Closed=False)
splitatcorners_2 = SplitAtCorners(Poly=pline_2, Angle=Slider(0.09, range=0..1))  # -> Corners, Parts
panel_2 = Panel(trim_3)
pline_3 = PolyLine(Vertices=splitatcorners_2.Corners, Closed=invert(False))
outpath = ClusterOutput(boundary)
fillet_5 = Fillet(Curve=pline_3, Radius=Slider(1, range=0..10))
boundary_5 = BoundarySurfaces(Edges=fillet_5)
move_3 = Move(Geometry=boundary_5, Motion=Z_2)  # -> Geometry, Transform
extr_3 = Extrude(Base=move_3.Geometry, Direction=multiplication_3)
S = ClusterOutput(boundary_5)
flatten_7 = FlattenTree(Tree=extr_3, Path="{0}")
trim_4 = TrimSolid(Shape=boundary_4, Cutters=flatten_7)  # disabled
boundary_6 = BoundarySurfaces(Edges=flatten([boundary_5, offset]))
trim_5 = TrimSolid(Shape=boundary_6, Cutters=extr)
R = ClusterOutput(trim_5)

# ==== cluster 场地周边种植
疏密度_0_1 = ClusterInput()
树木基础半径 = ClusterInput()
remap = RemapNumbers(Value=疏密度_0_1, Source=Domain(0, 1), Target=Domain(1, 0))  # -> Mapped, Clipped
C = ClusterInput()
D = ClusterInput()
combine = CombineData(Input0=remap.Mapped, Input1=Slider(0, range=0..1))  # -> Result, Index
combine_2 = CombineData(Input0=树木基础半径, Input1=Slider(2, range=0..10))  # -> Result, Index
number_slider = Slider(0.2, range=0..1)
offset = OffsetCurve(Curve=C, Distance=expr("-x/2", D), Corners=0)
随机程度 = ClusterInput()
seed = ClusterInput()
multiplication = Multiplication(A=combine_2.Result, B=2)
addition = Addition(A=combine.Result, B=1)
combine_3 = CombineData(Input0=随机程度, Input1=number_slider)  # -> Result, Index
combine_4 = CombineData(Input0=随机程度, Input1=number_slider)  # -> Result, Index
multiplication_2 = Multiplication(A=multiplication, B=addition)
subtraction = Subtraction(A=1, B=combine_4.Result)
addition_2 = Addition(A=combine_3.Result, B=1)
divlength = DivideLength(Curve=offset, Length=multiplication_2)  # -> Points, Tangents, Parameters
expression = Expression(x=combine_2.Result, y=subtraction, Expression="x*y")
expression_2 = Expression(x=combine_2.Result, y=addition_2, Expression="x*y")
expression_3 = Expression(x=D, Expression="x/2*1.5")
lng = ListLength(List=divlength.Points)
dom = ConstructDomain(DomainStart=expression, DomainEnd=expression_2)
c_script = CSharpScript(x=随机程度)  # -> A; inputs x: Double
# ---------- c_script: C# ----------
    A = (x == null || x == 0);
# ---------- end c_script ----------
random = Random(Range=dom, Number=lng, Seed=seed)
filter = StreamFilter(Gate=c_script, Stream0=random, Stream1=combine_2.Result)
c_script_2 = CSharpScript(x=filter, y=expression_3)  # -> out, A; inputs x: Double, y: Double
# ---------- c_script_2: C# ----------
    if(x >= y)
      A = y;
    else
      A = x;
# ---------- end c_script_2 ----------
cir = Circle(Plane=divlength.Points, Radius=c_script_2.A)
outputtrees = ClusterOutput(cir)

# ==== cluster 环绕种植
树木基础半径 = ClusterInput()
疏密度_0_1 = ClusterInput()
combine = CombineData(Input0=树木基础半径, Input1=Slider(2, range=0..10))  # -> Result, Index
remap = RemapNumbers(Value=疏密度_0_1, Source=Domain(0, 1), Target=Domain(1, 0))  # -> Mapped, Clipped
combine_2 = CombineData(Input0=remap.Mapped, Input1=Slider(0, range=0..1))  # -> Result, Index
multiplication = Multiplication(A=combine.Result, B=2)
number_slider = Slider(0.2, range=0..1)
addition = Addition(A=combine_2.Result, B=1)
随机程度 = ClusterInput()
seed = ClusterInput()
C = ClusterInput()
multiplication_2 = Multiplication(A=multiplication, B=addition)
divlength = DivideLength(Curve=C, Length=multiplication_2)  # -> Points, Tangents, Parameters
combine_3 = CombineData(Input0=随机程度, Input1=number_slider)  # -> Result, Index
combine_4 = CombineData(Input0=随机程度, Input1=number_slider)  # -> Result, Index
subtraction = Subtraction(A=1, B=combine_4.Result)
addition_2 = Addition(A=combine_3.Result, B=1)
expression = Expression(x=combine.Result, y=subtraction, Expression="x*y")
expression_2 = Expression(x=combine.Result, y=addition_2, Expression="x*y")
lng = ListLength(List=divlength.Points)
expression_3 = Expression(x=combine.Result, Expression="x*1.5")
dom = ConstructDomain(DomainStart=expression, DomainEnd=expression_2)
c_script = CSharpScript(x=随机程度)  # -> A; inputs x: Double; same code as c_script
random = Random(Range=dom, Number=lng, Seed=seed)
filter = StreamFilter(Gate=c_script, Stream0=random, Stream1=combine.Result)
c_script_2 = CSharpScript(x=filter, y=expression_3)  # -> out, A; inputs x: Double, y: Double; same code as c_script_2
cir = Circle(Plane=divlength.Points, Radius=c_script_2.A)
outputtrees = ClusterOutput(cir)

# ==== cluster 空地种植
custom_mesh_settings = SettingsCustom(
    StitchSeams=True,
    SimplePlanes=False,
    Refine=True,
    MinCount=16,
    MaxCount=400,
    AspectRatio=20,
    MaxDistance=0,
    MaxAngle=20,
    MinEdge=0,
    MaxEdge=0)
T = ClusterInput()
flatten = FlattenTree(Tree=T, Path="{0}")
mesh = MeshBrep(Brep=flatten, Settings=custom_mesh_settings)
mesh_2 = Mesh(mesh)
tri = Triangulate(Mesh=mesh_2)  # -> Mesh, Count
faceb = FaceBoundaries(Mesh=tri.Mesh)
explode = Explode(Curve=faceb, Recursive=True)  # -> Segments, Vertices
V = ClusterInput()
len = Length(Curve=explode.Segments)
sort = SortList(Keys=len, ValuesA=explode.Segments)  # -> Keys, ValuesA
item = ListItem(List=sort.ValuesA, Index=0, Wrap=True)
remap = RemapNumbers(Value=V, Source="0 to 10", Target="10 to 0")  # -> Mapped, Clipped
larger = LargerThan(FirstNumber=item, SecondNumber=remap.Mapped)  # -> LargerThan, OrEqualTo
flatten_2 = FlattenTree(Tree=faceb, Path="{0}")
flatten_3 = FlattenTree(Tree=larger.LargerThan, Path="{0}")
dispatch = Dispatch(List=flatten_2, DispatchPattern=flatten_3)  # -> ListA, ListB
crv = Curve(dispatch.ListA)
disc = Discontinuity(Curve=crv, Level=1)  # -> Points, Parameters
item_2 = ListItem(List=disc.Points, Index=0, Wrap=True)  # -> Item, Item1, Item2
incircle = InCircle(CornerA=item_2.Item, CornerB=item_2.Item1, CornerC=item_2.Item2)  # -> Circle, Plane, Radius
clean = CleanTree(RemoveNulls=True, RemoveInvalid=True, RemoveEmpty=False, Tree=flatten(incircle.Circle))
circle = Circle(clean)
circle_2 = ClusterOutput(circle)

# ==== cluster 与外围线连接的单一道路
T = ClusterInput()
外侧景观宽度 = ClusterInput()
flatten = FlattenTree(Tree=T, Path="{0}")
场地外围线 = ClusterInput()
外侧景观宽度_2 = Number(外侧景观宽度)
divide = DivideCurve(Curve=flatten, Count=1, Kinks=False)  # -> Points, Tangents, Parameters
场地外围线_2 = Curve(场地外围线)
num = ClusterInput()
外侧道路宽度 = ClusterInput()
area = Area(Geometry=场地外围线_2)  # -> Area, Centroid
num_2 = Number(num)
offset = OffsetCurve(Curve=场地外围线_2, Distance=expr("-x", 外侧景观宽度_2), Corners=1)
dist = Distance(PointA=divide.Points, PointB=area.Centroid)
sort = SortList(Keys=dist, ValuesA=divide.Points)  # -> Keys, ValuesA
division = Division(A=num_2, B=2)
addition = Addition(外侧景观宽度=外侧景观宽度_2, 外侧道路宽度=外侧道路宽度)
item = ListItem(List=sort.ValuesA, Index=0, Wrap=True)  # -> Item, Item1
ln = Line(StartPoint=item.Item1, EndPoint=item.Item)
offset_2 = OffsetCurve(Curve=场地外围线_2, Distance=expr("-x", addition), Corners=1)
flatten_2 = FlattenTree(Tree=ln, Path="{0}")
ext = ExtendCurve(Curve=flatten_2, Type=0, Start=Slider(10, range=0..10), End=0)
offset_3 = OffsetCurve(Curve=ext, Distance=expr("-x", division), Corners=1)
offset_4 = OffsetCurve(Curve=ext, Distance=division, Corners=1)
merge = Merge(Data1=offset_4, Data2=offset_3)
loft = Loft(Curves=merge, Options={Adjust=False, Closed=False, LoftEnds=0, LoftSimp=0, LoftType=0, Rebuild=10, Refit=0.01})
倒角半径 = ClusterInput()
rdiff = RegionDifference(CurvesA=offset_2, CurvesB=flatten(loft))
倒角半径_2 = Number(倒角半径)
fillet = Fillet(Curve=rdiff, Radius=倒角半径_2)
fillet_2 = Fillet(Curve=offset, Radius=倒角半径_2)
boundary = BoundarySurfaces(Edges=flatten([fillet, fillet_2]))
outputpath = ClusterOutput(boundary)

# ==== cluster 创建道路_Bake前
unit = ClusterInput()
外侧道路宽度 = ClusterInput()
combine = CombineData(Input0=unit, Input1=Slider(1, range=0..1))  # -> Result, Index
combine_2 = CombineData(Input0=外侧道路宽度, Input1=Slider(7, range=0..10))  # -> Result, Index
unit_2 = Number(combine.Result)
场地外围线 = ClusterInput()
外侧景观宽度 = ClusterInput()
multiplication = Multiplication(外围道路宽度=combine_2.Result, B=unit_2)
crv = Curve(场地外围线)
combine_3 = CombineData(Input0=外侧景观宽度, Input1=Slider(6, range=0..10))  # -> Result, Index
轴线指定宽度 = ClusterInput()
连接道路宽度 = ClusterInput()
连接道路 = ClusterInput()
主要道路 = ClusterInput()
offset = OffsetCurve(Curve=crv, Distance=expr("-x", combine_3.Result), Corners=1)
offset_2 = OffsetCurve(Curve=offset, Distance=expr("-x", multiplication), Corners=1)
fillet = Fillet(Curve=offset_2, Radius=Slider(6, range=0..10))
crv_2 = Curve(连接道路)
楼栋平面 = ClusterInput()
楼栋平面_2 = Curve(楼栋平面)

# ---- group: 在与楼栋平面相交处延长连接线，保证道路完整性
flatten = FlattenTree(Tree=crv_2, Path="{0}")
divide = DivideCurve(Curve=flatten, Count=Slider(1, range=0..1), Kinks=False)  # -> Points, Tangents, Parameters
graft = GraftTree(Tree=divide.Points, IncludeEmptyLists=True, IncludeNullItems=True)
crv_cp = CurveClosestPoint(Point=graft, Curve=楼栋平面_2)  # -> Point, Parameter, Distance
sort = SortList(Keys=crv_cp.Distance)  # -> Keys, ValuesA
item = ListItem(List=sort.Keys, Index=0, Wrap=True)
trim = TrimTree(Tree=item, Depth=1)
item_2 = ListItem(List=trim, Index=0, Wrap=True)
smaller = SmallerThan(FirstNumber=item_2, SecondNumber=Slider(0.1, range=0..0.1))  # -> SmallerThan, OrEqualTo
equals = Equality(FirstNumber=item_2, SecondNumber=0)  # -> Equality, Inequality
dispatch = Dispatch(List=flatten, DispatchPattern=flatten(smaller.SmallerThan))  # -> ListA, ListB
flip = FlipCurve(Curve=dispatch.ListB)  # -> Curve, Flag
entwine = Entwine(Branch00=dispatch.ListA, Branch01=flip.Curve, FlattenInputs=True)
flatten_2 = FlattenTree(Tree=entwine, Path="{0}")
ext = ExtendCurve(Curve=flatten_2, Type=0, Start=Slider(5, range=0..10), End=Slider(0, range=0..100))

# ----
Z = UnitZ(Factor=1)
multiplication_2 = Multiplication(A=Z, B=-2)
move = Move(Geometry=楼栋平面_2, Motion=Z)  # -> Geometry, Transform
boundary = BoundarySurfaces(Edges=move.Geometry)
extr = Extrude(Base=boundary, Direction=multiplication_2)
fillet_2 = Fillet(Curve=ext, Radius=Slider(3, range=0..10))
主路分块 = 主路分块(连接道路=fillet_2, 连接道路宽度=连接道路宽度, T=轴线指定宽度, E=fillet, crv=主要道路)  # -> 地块环线, T_2

# ---- group: 楼栋平面修剪道路区域，并保证修剪后道路是闭合曲线
trim_2 = TrimWithRegions(Curve=主路分块.T_2, Regions=楼栋平面_2)  # -> Inside, Outside; disabled
crv_3 = Curve(trim_2.Outside)  # disabled
cls = Closed(Curve=crv_3)  # -> Closed, Periodic; disabled
dispatch_2 = Dispatch(List=crv_3, DispatchPattern=cls.Closed)  # -> ListA, ListB; disabled
end = EndPoints(Curve=dispatch_2.ListB)  # -> Start, End; disabled
ln = Line(StartPoint=end.Start, EndPoint=end.End)  # disabled
merge = Merge(Data1=ln, Data2=dispatch_2.ListB)  # disabled
join = JoinCurves(Curves=merge, Preserve=False)  # disabled
merge_2 = Merge(Data1=simplify(join), Data2=simplify(dispatch_2.ListA))  # disabled

# ----
crv_4 = Curve(offset)
plotboundary = ClusterOutput(主路分块.地块环线)
boundary_2 = BoundarySurfaces(Edges=flatten([主路分块.T_2, crv_4]))
trim_3 = TrimSolid(Shape=boundary_2, Cutters=extr)
edges = BrepEdges(Brep=trim_3)  # -> Naked, Interior, NonManifold
join_2 = JoinCurves(Curves=edges.Naked, Preserve=False)
flatten_3 = FlattenTree(Tree=join_2, Path="{0}")
area = Area(Geometry=crv_4)  # -> Area, Centroid
area_2 = Area(Geometry=flatten_3)  # -> Area, Centroid
similar = Similarity(FirstNumber=area.Area, SecondNumber=area_2.Area, Threshold=0.1)  # -> Similarity, AbsoluteDifference
dispatch_3 = Dispatch(List=flatten_3, DispatchPattern=similar.Similarity)  # -> ListA, ListB
graft_2 = GraftTree(Tree=dispatch_3.ListB, IncludeEmptyLists=True, IncludeNullItems=True)

# ---- group: 与楼栋交接处不倒角，其余地方正常倒角
crv_5 = Curve(reparameterize(graft_2))
disc = Discontinuity(Curve=crv_5, Level=1)  # -> Points, Parameters
flatten_4 = FlattenTree(Tree=disc.Points, Path="{0}")
crv_cp_2 = CurveClosestPoint(Point=graft(flatten_4), Curve=flatten(楼栋平面_2))  # -> Point, Parameter, Distance
sort_2 = SortList(Keys=crv_cp_2.Distance)  # -> Keys, ValuesA
item_3 = ListItem(List=sort_2.Keys, Index=0, Wrap=True)
smaller_2 = SmallerThan(FirstNumber=item_3, SecondNumber=Slider(0.1, range=0..0.1))  # -> SmallerThan, OrEqualTo
flatten_5 = FlattenTree(Tree=smaller_2.SmallerThan, Path="{0}")
unflatten = UnflattenTree(Tree=flatten_5, Guide=disc.Parameters)
dispatch_4 = Dispatch(List=disc.Parameters, DispatchPattern=unflatten)  # -> ListA, ListB
fillet_3 = Fillet(Curve=crv_5, Parameter=dispatch_4.ListB, Radius=Slider(3, range=0..10))  # -> Curve, Parameter
crv_6 = Curve(fillet_3.Curve)
multiplecrv_booleanintersection = CSharpScript(crv=crv_6)  # -> out, A; inputs crv: list of Curve; same code as multiplecrv_booleanintersection
crv_7 = Curve(offset)
boundary_3 = BoundarySurfaces(Edges=flatten([crv_7, multiplecrv_booleanintersection.A]))

# ----
rdiff = RegionDifference(CurvesA=multiplecrv_booleanintersection.A, CurvesB=楼栋平面_2)
boundary_4 = BoundarySurfaces(Edges=flatten(rdiff))
outempty = ClusterOutput(boundary_4)
outpath = ClusterOutput(boundary_3)

# ==== cluster 警告
bounds = GetViewportBoundaryDimensions(Refresh=True, Origin=Point(0, 0, 0), Scale=0.25, xDim=1614, yDim=809)
pcen = PolygonCenter(Polyline=bounds)  # -> CenterV, CenterE, CenterA
vec2pt = Vector2Pt(PointA=pcen.CenterV, PointB="{0,0,0}", Unitize=False)  # -> Vector, Length
move = Move(Geometry=bounds, Motion=vec2pt.Vector)  # -> Geometry, Transform
height = ClusterInput()
scale = Scale(Geometry=move.Geometry, Center=Point(0, 0, 0), Factor=Slider(0.1, range=0..1))  # -> Geometry, Transform
text = ClusterInput()
G = ClusterOutput(move.Geometry)
font = ConduitFont(
    Font="Arial",
    TextHeight=height,
    AdaptiveHeight=True,
    TextSpacing=1.15,
    Alignment=Slider(1, range=0..1),
    Bold=invert(False),
    Italic=False,
    Color=RGB(0, 0, 0))
hud_text = DrawText(
    Boundary=scale.Geometry,
    Text=text,
    TextOrdering=1,
    TextDistribution=Slider(1, range=0..1),
    ColorOverride=RGB(255, 0, 0),
    OrientVertically=False,
    CustomFont=font)
drawobjs = ClusterOutput(hud_text)

# ==== cluster 轴线分割: 沿轴线将场地进行初步分割; 可以分别调整y轴正负方向的偏移量
crv = ClusterInput()
E = ClusterInput()
crv_2 = Curve(crv)
graft = GraftTree(Tree=crv_2, IncludeEmptyLists=True, IncludeNullItems=True)
item = ListItem(List=graft, Index=0, Wrap=True)

# ---- group: 判定是否更趋向于x轴
end = EndPoints(Curve=graft)  # -> Start, End
vec2pt = Vector2Pt(PointA=end.Start, PointB=end.End, Unitize=False)  # -> Vector, Length
X = UnitX(Factor=1)
rev = Reverse(Vector=X)
angle = Angle(VectorA=vec2pt.Vector, VectorB=rev)  # -> Angle, Reflex
angle_2 = Angle(VectorA=vec2pt.Vector, VectorB=X)  # -> Angle, Reflex
pi = Pi(Factor=Slider(0.25, range=0..1))
smaller = SmallerThan(FirstNumber=angle_2.Angle, SecondNumber=pi)  # -> SmallerThan, OrEqualTo
smaller_2 = SmallerThan(FirstNumber=angle.Angle, SecondNumber=pi)  # -> SmallerThan, OrEqualTo
or = GateOr(A=smaller.SmallerThan, B=smaller_2.SmallerThan)

# ---- group: 确定x，y轴的避让距离
bbox = BoundingBox(Content=E, Plane=PlaneXY(0, 0, 0))  # -> Box, Box_2
底面边界 = 底面边界(B=bbox.Box, G=0)
cluster = Cluster(C=底面边界, axis="x")
cluster_2 = Cluster(C=底面边界, axis="y")
number_slider = Slider(5, range=0..10)
division = Division(A=cluster, B=number_slider)
division_2 = Division(A=cluster_2, B=number_slider)
X_2 = UnitX(Factor=1)
Y = UnitY(Factor=1)
contour = Contour(Shape=E, Point=Point(0, 0, 0), Direction=X_2, Distance=division)
contour_2 = Contour(Shape=E, Point=Point(0, 0, 0), Direction=Y, Distance=division_2)
len = Length(Curve=contour)  # -> flatten(Length)
len_2 = Length(Curve=contour_2)  # -> flatten(Length)
number_slider_2 = Slider(15, range=0..100)
avr = Average(Input=len)
avr_2 = Average(Input=len_2)
division_3 = Division(A=avr, B=number_slider_2)
division_4 = Division(A=avr_2, B=number_slider_2)

# ----
dispatch = Dispatch(List=graft, DispatchPattern=or)  # -> ListA, ListB
boundary = BoundarySurfaces(Edges=E)
轴线控制比例 = ClusterInput()  # 用于控制道路与实际排布地块，最高为1，用于道路时适当降低
y轴方向避让距离 = Number(division_3)
x轴方向避让距离 = Number(division_4)
_0 = ClusterInput()
multiplication = Multiplication(A=轴线控制比例, B=x轴方向避让距离)
multiplication_2 = Multiplication(A=轴线控制比例, B=y轴方向避让距离)
combine = CombineData(Input0=_0, Input1=multiplication_2)  # -> Result, Index
combine_2 = CombineData(Input0=_0, Input1=multiplication)  # -> Result, Index
num = Number(combine_2.Result)
num_2 = Number(combine.Result)

# ---- group: 判断线段偏移正负方向，y轴负方向会偏移更多
midpt = CurveMiddle(Curve=dispatch.ListA)
crv_cp = CurveClosestPoint(Point=midpt, Curve=dispatch.ListA)  # -> Point, Parameter, Distance
hframe = HorizontalFrame(Curve=dispatch.ListA, Parameter=crv_cp.Parameter)
deplane = DeconstructPlane(Plane=hframe)  # -> Origin, XAxis, YAxis, ZAxis
c_script = CSharpScript(Vec=deplane.YAxis)  # -> yPositive, yNegative; inputs Vec: Vector3d
# ---------- c_script: C# ----------
    Vector3d yVec = new Vector3d(0, 1, 0);
    if(Vec * yVec > 0)
    {
      yPositive = Vec;
      yNegative = -Vec;
    }
    if(Vec * yVec < 0)
    {
      yPositive = -Vec;
      yNegative = Vec;
    }
# ---------- end c_script ----------
pl = ConstructPlane(Origin=deplane.Origin, XAxis=deplane.XAxis, YAxis=c_script.yNegative)
pl_2 = ConstructPlane(Origin=deplane.Origin, XAxis=deplane.XAxis, YAxis=c_script.yPositive)
multiplication_3 = Multiplication(A=Slider(1, range=0..10), B=num_2)
offset = OffsetCurve(Curve=dispatch.ListA, Distance=num_2, Plane=pl, Corners=1)
offset_2 = OffsetCurve(Curve=dispatch.ListA, Distance=multiplication_3, Plane=pl_2, Corners=1)

# ----
offset_3 = OffsetCurve(Curve=dispatch.ListB, Distance=expr("-x", num), Corners=1)
offset_4 = OffsetCurve(Curve=dispatch.ListB, Distance=num, Corners=1)
simplify = SimplifyTree(Tree=offset, Front=False)
simplify_2 = SimplifyTree(Tree=offset_2, Front=False)
连接道路宽度 = ClusterInput()
simplify_3 = SimplifyTree(Tree=offset_4, Front=False)
simplify_4 = SimplifyTree(Tree=offset_3, Front=False)
连接道路 = ClusterInput()
division_5 = Division(A=连接道路宽度, B=2)
merge = Merge(Data1=simplify_3, Data2=simplify_4, Data3=simplify, Data4=simplify_2)
combine_3 = CombineData(Input0=division_5, Input1=Slider(1.5, range=0..10))  # -> Result, Index
clean = CleanTree(RemoveNulls=True, RemoveInvalid=True, RemoveEmpty=False, Tree=merge)
offset_5 = OffsetCurve(Curve=连接道路, Distance=expr("-x", combine_3.Result), Corners=1)
offset_6 = OffsetCurve(Curve=连接道路, Distance=combine_3.Result, Corners=1)
Z = UnitZ(Factor=1)
loft = Loft(Curves=clean, Options={Adjust=False, Closed=False, LoftEnds=0, LoftSimp=0, LoftType=0, Rebuild=10, Refit=0.01})
merge_2 = Merge(Data1=offset_6, Data2=offset_5)
panel = Panel(clean)
multiplication_4 = Multiplication(A=Z, B="-2")
loft_2 = Loft(Curves=merge_2, Options={Adjust=False, Closed=False, LoftEnds=0, LoftSimp=0, LoftType=0, Rebuild=10, Refit=0.01})
entwine = Entwine(Branch00=loft_2, Branch01=loft, FlattenInputs=True)
move = Move(Geometry=entwine, Motion=Z)  # -> Geometry, Transform
extr = Extrude(Base=move.Geometry, Direction=multiplication_4)
flatten = FlattenTree(Tree=extr, Path="{0}")
clean_2 = CleanTree(RemoveNulls=True, RemoveInvalid=True, RemoveEmpty=False, Tree=flatten)
trim = TrimSolid(Shape=boundary, Cutters=clean_2)
edges = BrepEdges(Brep=trim)  # -> Naked, Interior, NonManifold
join = JoinCurves(Curves=edges.Naked, Preserve=False)
simplify_5 = SimplifyTree(Tree=join, Front=False)
T = ClusterOutput(simplify_5)

# ==== cluster 主路分块: 沿轴线将场地进行初步分割; 可以分别调整y轴正负方向的偏移量
crv = ClusterInput()
E = ClusterInput()
crv_2 = Curve(crv)
graft = GraftTree(Tree=crv_2, IncludeEmptyLists=True, IncludeNullItems=True)
item = ListItem(List=graft, Index=0, Wrap=True)

# ---- group: 判定是否更趋向于x轴
end = EndPoints(Curve=graft)  # -> Start, End
vec2pt = Vector2Pt(PointA=end.Start, PointB=end.End, Unitize=False)  # -> Vector, Length
X = UnitX(Factor=1)
rev = Reverse(Vector=X)
angle = Angle(VectorA=vec2pt.Vector, VectorB=rev)  # -> Angle, Reflex
angle_2 = Angle(VectorA=vec2pt.Vector, VectorB=X)  # -> Angle, Reflex
pi = Pi(Factor=Slider(0.25, range=0..1))
smaller = SmallerThan(FirstNumber=angle_2.Angle, SecondNumber=pi)  # -> SmallerThan, OrEqualTo
smaller_2 = SmallerThan(FirstNumber=angle.Angle, SecondNumber=pi)  # -> SmallerThan, OrEqualTo
or = GateOr(A=smaller.SmallerThan, B=smaller_2.SmallerThan)

# ---- group: 确定x，y轴的避让距离
bbox = BoundingBox(Content=E, Plane=PlaneXY(0, 0, 0))  # -> Box, Box_2; disabled
底面边界 = 底面边界(B=bbox.Box, G=0)  # disabled
panel = Panel("x")  # disabled
panel_2 = Panel("y")  # disabled
cluster = Cluster(C=底面边界, axis=panel)  # disabled
cluster_2 = Cluster(C=底面边界, axis=panel_2)  # disabled
number_slider = Slider(5, range=0..10)  # disabled
division = Division(A=cluster, B=number_slider)  # disabled
division_2 = Division(A=cluster_2, B=number_slider)  # disabled
X_2 = UnitX(Factor=1)  # disabled
Y = UnitY(Factor=1)  # disabled
contour = Contour(Shape=E, Point=Point(0, 0, 0), Direction=X_2, Distance=division)  # disabled
contour_2 = Contour(Shape=E, Point=Point(0, 0, 0), Direction=Y, Distance=division_2)  # disabled
len = Length(Curve=contour)  # -> flatten(Length); disabled
len_2 = Length(Curve=contour_2)  # -> flatten(Length); disabled
number_slider_2 = Slider(15, range=0..100)  # disabled
avr = Average(Input=len)  # disabled
avr_2 = Average(Input=len_2)  # disabled
division_3 = Division(A=avr, B=number_slider_2)  # disabled
division_4 = Division(A=avr_2, B=number_slider_2)  # disabled

# ----
dispatch = Dispatch(List=graft, DispatchPattern=or)  # -> ListA, ListB
boundary = BoundarySurfaces(Edges=E)
lng = ListLength(List=crv_2)
T = ClusterInput()
dup = DuplicateData(Data=Slider(5, range=0..10), Number=lng, Order=True)
flatten = FlattenTree(Tree=T, Path="{0}")
combine = CombineData(Input0=flatten, Input1=dup)  # -> Result, Index
division_5 = Division(A=combine.Result, B=2)
graft_2 = GraftTree(Tree=division_5, IncludeEmptyLists=True, IncludeNullItems=True)
dispatch_2 = Dispatch(List=graft_2, DispatchPattern=or)  # -> ListA, ListB

# ---- group: 判断线段偏移正负方向，y轴负方向会偏移更多
midpt = CurveMiddle(Curve=dispatch.ListA)
crv_cp = CurveClosestPoint(Point=midpt, Curve=dispatch.ListA)  # -> Point, Parameter, Distance
hframe = HorizontalFrame(Curve=dispatch.ListA, Parameter=crv_cp.Parameter)
deplane = DeconstructPlane(Plane=hframe)  # -> Origin, XAxis, YAxis, ZAxis
c_script = CSharpScript(Vec=deplane.YAxis)  # -> yPositive, yNegative; inputs Vec: Vector3d; same code as c_script
pl = ConstructPlane(Origin=deplane.Origin, XAxis=deplane.XAxis, YAxis=c_script.yNegative)
pl_2 = ConstructPlane(Origin=deplane.Origin, XAxis=deplane.XAxis, YAxis=c_script.yPositive)
multiplication = Multiplication(A=Slider(1, range=0..10), B=dispatch_2.ListA)
offset = OffsetCurve(Curve=dispatch.ListA, Distance=dispatch_2.ListA, Plane=pl, Corners=1)
offset_2 = OffsetCurve(Curve=dispatch.ListA, Distance=dispatch_2.ListA, Plane=pl_2, Corners=1)

# ----
num = Number(division_5)
num_2 = Number(division_5)
offset_3 = OffsetCurve(Curve=dispatch.ListB, Distance=expr("-x", dispatch_2.ListB), Corners=1)
offset_4 = OffsetCurve(Curve=dispatch.ListB, Distance=dispatch_2.ListB, Corners=1)
simplify = SimplifyTree(Tree=offset, Front=False)
simplify_2 = SimplifyTree(Tree=offset_2, Front=False)
连接道路宽度 = ClusterInput()
simplify_3 = SimplifyTree(Tree=offset_4, Front=False)
simplify_4 = SimplifyTree(Tree=offset_3, Front=False)
连接道路 = ClusterInput()
division_6 = Division(A=连接道路宽度, B=2)
merge = Merge(Data1=simplify_3, Data2=simplify_4, Data3=simplify, Data4=simplify_2)
combine_2 = CombineData(Input0=division_6, Input1=Slider(1.5, range=0..10))  # -> Result, Index
clean = CleanTree(RemoveNulls=True, RemoveInvalid=True, RemoveEmpty=False, Tree=merge)
offset_5 = OffsetCurve(Curve=连接道路, Distance=expr("-x", combine_2.Result), Corners=1)
offset_6 = OffsetCurve(Curve=连接道路, Distance=combine_2.Result, Corners=1)
Z = UnitZ(Factor=1)
loft = Loft(Curves=clean, Options={Adjust=False, Closed=False, LoftEnds=0, LoftSimp=0, LoftType=0, Rebuild=10, Refit=0.01})
merge_2 = Merge(Data1=offset_6, Data2=offset_5)
panel_3 = Panel(clean)
multiplication_2 = Multiplication(A=Z, B="-2")
loft_2 = Loft(Curves=merge_2, Options={Adjust=False, Closed=False, LoftEnds=0, LoftSimp=0, LoftType=0, Rebuild=10, Refit=0.01})
entwine = Entwine(Branch00=loft_2, Branch01=loft, FlattenInputs=True)
move = Move(Geometry=entwine, Motion=Z)  # -> Geometry, Transform
extr = Extrude(Base=move.Geometry, Direction=multiplication_2)
flatten_2 = FlattenTree(Tree=extr, Path="{0}")
clean_2 = CleanTree(RemoveNulls=True, RemoveInvalid=True, RemoveEmpty=False, Tree=flatten_2)
edges = BrepEdges(Brep=loft)  # -> Naked, Interior, NonManifold
trim = TrimSolid(Shape=boundary, Cutters=clean_2)
join = JoinCurves(Curves=edges.Naked, Preserve=False)
edges_2 = BrepEdges(Brep=trim)  # -> Naked, Interior, NonManifold
rdiff = RegionDifference(CurvesA=boundary, CurvesB=flatten(join))
join_2 = JoinCurves(Curves=edges_2.Naked, Preserve=False)
flatten_3 = FlattenTree(Tree=rdiff, Path="{0}")
simplify_5 = SimplifyTree(Tree=join_2, Front=False)
地块环线 = ClusterOutput(flatten_3)
T_2 = ClusterOutput(simplify_5)

# ==== cluster Cluster: 指定轴线方向矩形长度
C = ClusterInput()
axis = ClusterInput()
explode = Explode(Curve=C, Recursive=True)  # -> Segments, Vertices
c_script = CSharpScript(axis=axis)  # -> A; inputs axis: String
# ---------- c_script: C# ----------
    if(axis == "x" || axis == "X") A = 0;
    if(axis == "y" || axis == "Y") A = 1;
    if(axis == "z" || axis == "Z") A = 2;
# ---------- end c_script ----------
midpt = CurveMiddle(Curve=explode.Segments)
pdecon = Deconstruct(Point=midpt)  # -> XComponent, YComponent, ZComponent
filter = StreamFilter(Gate=c_script, Stream0=pdecon.XComponent, Stream1=pdecon.YComponent, Stream2=pdecon.ZComponent)
item = ListItem(List=filter, Index=0, Wrap=True)  # -> Item, Item1, Item2, Item3
subtraction = Subtraction(A=item.Item, B=item.Item2)
subtraction_2 = Subtraction(A=item.Item1, B=item.Item3)
abs = Absolute(Value=subtraction)
abs_2 = Absolute(Value=subtraction_2)
c_script_2 = CSharpScript(x=abs, y=abs_2)  # -> A; inputs x: Double, y: Double
# ---------- c_script_2: C# ----------
    if(x > y) A = x;
    else A = y;
# ---------- end c_script_2 ----------
length = ClusterOutput(c_script_2)

# ==== cluster 底面边界: 获取物体上下面边界曲线Polyline； G为0时取底面边界； G为1时取顶面边界；
B = ClusterInput()
debrep = DeconstructBrep(Brep=B)  # -> Faces, Edges, Vertices
pcen = PolygonCenter(Polyline=debrep.Faces)  # -> CenterV, CenterE, CenterA
pdecon = Deconstruct(Point=pcen.CenterV)  # -> XComponent, YComponent, ZComponent
sort = SortList(Keys=pdecon.ZComponent, ValuesA=debrep.Faces)  # -> Keys, ValuesA
item = ListItem(List=reverse(sort.ValuesA), Index=0, Wrap=True)
item_2 = ListItem(List=sort.ValuesA, Index=0, Wrap=True)
G = ClusterInput()
filter = StreamFilter(Gate=G, Stream0=item_2, Stream1=item)
edges = BrepEdges(Brep=filter)  # -> Naked, Interior, NonManifold
join = JoinCurves(Curves=edges.Naked, Preserve=False)
trim = TrimTree(Tree=join, Depth=Slider(3, range=0..10))
T = ClusterOutput(trim)
