# Grasshopper definition test.gh (Grasshopper 1.0.7)

number_slider = Slider(1, range=0..1)
toggle = BooleanToggle(False)
pt = ConstructPoint(XCoordinate=0, YCoordinate=0, ZCoordinate=0)
pt_2 = ConstructPoint(XCoordinate=number_slider, YCoordinate=number_slider, ZCoordinate=0)
crv = Curve(<curve referenced from the Rhino model>)
